# Grasshopper definition PFHG_001.gh (Grasshopper 1.0.7)
# plug-ins: Hops

# ----
# PFHG_001.py
# Examples Wickerson Studios
# Examples on McNeel
panel = Panel("2")
# McNeel, Compute | AECtech 2021 NYC
# Setting up a Python Server
# https://www.youtube.com/watch?v=v_Y2-5VpCSQ
# 1:46:00 minute make
# 
# preresquisites:
# Visual Studio Code
# CPython 3.10 or higher
# CMake 3.22 or higher
# https://www.kitware.com/cmake-3-22-0-available-for-download/
# 
# 
# Flask (optional middle ware)
# 
# 
# Close repo at:
# https://github.com/mcneel/compute.rhino3d
# 
# pip install ghhops_server flask
# 
# Got to Visual Studio Code
# open  folder, src, ghhops-server.py, examples
# This starts server
# check out @hops definitions:
# 
# @hops.component(
#     "/pointat",
#     name="PointAt",
#     nickname="PtAt",
#     description="Get point along curve",
#     icon="pointat.png",
#     inputs=[
#         hs.HopsCurve("Curve", "C", "Curve to evaluate"),
#         hs.HopsNumber("t", "t", "Parameter on Curve to evaluate")
#     ],
#     outputs=[hs.HopsPoint("P", "P", "Point on curve at t")]
# )
# def pointat(curve: rhino3dm.Curve, t=0.0):
#     return curve.PointAt(t)
# 
# Now you can use all the  Python 3.0 Libraries
# NumPy
# Pandas
# DataFrames
# etc...
# 
# Visual Studio Code
# Terminal
# IP address
# over to grasshopper and hops component
# use the
# /pointat locator
# WOW!!!
panel_2 = Panel("2")
series = Series(Start=panel, Step=1, Count=panel)
series_2 = Series(Start=panel_2, Step=panel_2, Count=panel_2)
construct_point = ConstructPoint(XCoordinate=series_2, YCoordinate=series_2, ZCoordinate=0)  # -> graft(Point)
construct_point_2 = ConstructPoint(XCoordinate=0, YCoordinate=series, ZCoordinate=series)  # -> graft(Point)
explode_tree = ExplodeTree(Data=construct_point)  # -> Branch0, Branch1
explode_tree_2 = ExplodeTree(Data=construct_point_2)  # -> Branch0, Branch1
curve = Curve(reparameterize(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))
curve_2 = Curve(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)
binmult = Hops(
    A=Slider(2, range=0..10),
    B=Slider(2, range=0..10),
    CacheResultsInMemory=True,
    CacheSolveResults=True,
    RemoteDefinitionLocation="http://127.0.0.1:5000/binmult",
    RemoteSolveVersion=(0, 1, 0),
    ShowInput_Enabled=False,
    ShowInput_Path=False,
    SynchronousSolve=True)
hops = Hops(
    Curve=curve,
    CacheResultsInMemory=True,
    CacheSolveResults=True,
    RemoteDefinitionLocation="http://127.0.0.1:5000/curve_end_points",
    RemoteSolveVersion=(0, 1, 0),
    ShowInput_Enabled=False,
    ShowInput_Path=False,
    SynchronousSolve=True)  # -> S, E, EE
pointat = Hops(
    Curve=reparameterize(curve_2),
    T=Slider(0.41, range=0..2),
    CacheResultsInMemory=True,
    CacheSolveResults=True,
    RemoteDefinitionLocation="http://127.0.0.1:5000/pointat",
    RemoteSolveVersion=(0, 1, 0),
    ShowInput_Enabled=False,
    ShowInput_Path=False,
    SynchronousSolve=True)
add = Hops(
    A=Slider(2, range=0..10),
    B=Slider(2, range=0..10),
    CacheResultsInMemory=True,
    CacheSolveResults=True,
    RemoteDefinitionLocation="http://127.0.0.1:5000/add",
    RemoteSolveVersion=(0, 1, 0),
    ShowInput_Enabled=False,
    ShowInput_Path=False,
    SynchronousSolve=True)
srf4pt = Hops(
    CornerA=explode_tree.Branch0,
    CornerB=explode_tree.Branch1,
    CornerC=explode_tree_2.Branch0,
    CornerD=explode_tree_2.Branch1,
    CacheResultsInMemory=True,
    CacheSolveResults=True,
    RemoteDefinitionLocation="http://127.0.0.1:5000/srf4pt",
    RemoteSolveVersion=(0, 1, 0),
    ShowInput_Enabled=False,
    ShowInput_Path=False,
    SynchronousSolve=True)
panel_3 = Panel(srf4pt)
panel_4 = Panel([hops.S, hops.E, hops.EE])
panel_5 = Panel(add)
panel_6 = Panel(binmult)
panel_7 = Panel(pointat)
squares = Hops(
    X=Slider(2, range=0..10),
    Y=Slider(2, range=0..10),
    CacheResultsInMemory=True,
    CacheSolveResults=True,
    RemoteDefinitionLocation="http://127.0.0.1:5000/squares",
    RemoteSolveVersion=(0, 1, 0),
    ShowInput_Enabled=False,
    ShowInput_Path=False,
    SynchronousSolve=True)
squares2 = Hops(
    X=Slider(2, range=0..10),
    CacheResultsInMemory=True,
    CacheSolveResults=True,
    RemoteDefinitionLocation="http://127.0.0.1:5000/squares2",
    RemoteSolveVersion=(0, 1, 0),
    ShowInput_Enabled=False,
    ShowInput_Path=False,
    SynchronousSolve=True)
calculator = Hops(
    A=Slider(6, range=0..10),
    B=Slider(3, range=0..10),
    CacheResultsInMemory=False,
    CacheSolveResults=False,
    RemoteDefinitionLocation="http://127.0.0.1:5000/calculator",
    RemoteSolveVersion=(0, 1, 0),
    ShowInput_Enabled=False,
    ShowInput_Path=False,
    SynchronousSolve=True)  # -> Addition, Subtraction, Multiplication, Division
times = Hops(
    A=Slider(7, range=0..10),
    B=Slider(4, range=0..10),
    CacheResultsInMemory=True,
    CacheSolveResults=True,
    RemoteDefinitionLocation="http://127.0.0.1:5000/times",
    RemoteSolveVersion=(0, 1, 0),
    ShowInput_Enabled=False,
    ShowInput_Path=False,
    SynchronousSolve=True)
minus = Hops(
    A=Slider(7, range=0..10),
    B=Slider(4, range=0..10),
    CacheResultsInMemory=True,
    CacheSolveResults=True,
    RemoteDefinitionLocation="http://127.0.0.1:5000/minus",
    RemoteSolveVersion=(0, 1, 0),
    ShowInput_Enabled=False,
    ShowInput_Path=False,
    SynchronousSolve=True)
panel_8 = Panel([calculator.Addition, calculator.Subtraction, calculator.Multiplication, calculator.Division])
panel_9 = Panel(squares)
panel_10 = Panel(times)
panel_11 = Panel(squares2)
panel_12 = Panel(minus)

# ----
# PFHG_002.py
# Examples Wickerson Studios
# Examples on McNeel
number_slider = Slider(2, range=0..10)
advanced_calculator = Hops(
    A=Slider(2.886, range=0..10),
    B=number_slider,
    CacheResultsInMemory=False,
    CacheSolveResults=False,
    RemoteDefinitionLocation="http://127.0.0.1:5000/advanced_calculator",
    RemoteSolveVersion=(0, 1, 0),
    ShowInput_Enabled=False,
    ShowInput_Path=False,
    SynchronousSolve=True)  # -> DivideDown, Modulus, Negative, CastInt, CastFloat, Exponent
panel_13 = Panel([advanced_calculator.DivideDown, advanced_calculator.Modulus, advanced_calculator.Negative, advanced_calculator.CastInt, advanced_calculator.CastFloat, advanced_calculator.Exponent])
