# Grasshopper definition PFHG_003.gh (Grasshopper 1.0.7)
# plug-ins: Hops

# ----
# PFHG_003.py
# Examples on McNeel
# install matplotlib
number_slider = Slider(10, range=0..10)
curve = Curve(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)
number_slider_2 = Slider(0.49, range=0..1)
# FLASK | HOPS | PYTHON 3 | GRASSHOPPER
curve_end_points = Hops(
    Curve=reparameterize(curve),
    CacheResultsInMemory=False,
    CacheSolveResults=False,
    RemoteDefinitionLocation="http://127.0.0.1:5000/curve_end_points",
    RemoteSolveVersion=(0, 1, 0),
    ShowInput_Enabled=False,
    ShowInput_Path=False,
    SynchronousSolve=True)  # -> S, E
range = Range(Domain=Domain(0, 1), Steps=number_slider)
unit_z = UnitZ(Factor=Slider(20, range=0..100))
square = Square(Plane=PlaneXY(0, 0, 0), Size=1, ExtentX=5, ExtentY=5)  # -> Cells, Points
point = Point([curve_end_points.S, curve_end_points.E])
square_2 = Square(Plane=PlaneXY(0, 0, 0), Size=1, ExtentX=5, ExtentY=5)  # -> Cells, flatten(Points)
boolean_toggle = BooleanToggle(False)
move = Move(Geometry=point, Motion=unit_z)  # -> Geometry, Transform
pointsat = Hops(
    Curve=reparameterize(curve),
    T=range,
    CacheResultsInMemory=True,
    CacheSolveResults=True,
    RemoteDefinitionLocation="http://127.0.0.1:5000/pointsat",
    RemoteSolveVersion=(0, 1, 0),
    ShowInput_Enabled=False,
    ShowInput_Path=False,
    SynchronousSolve=True)
panel = Panel(square.Points)
delaunay_mesh = DelaunayMesh(Points=square_2.Points, Plane=PlaneXY(0, 0, 0))
panel_2 = Panel(pointsat)
dispatch = Dispatch(List=flatten(move.Geometry), DispatchPattern=[True, False])  # -> ListA, ListB
deconstruct_mesh = DeconstructMesh(Mesh=delaunay_mesh)  # -> Vertices, Faces, Colours, Normals
line = Line(StartPoint=dispatch.ListB, EndPoint=dispatch.ListA)
hops = Hops(
    Points=deconstruct_mesh.Vertices,
    Integer=Slider(0, range=0..100),
    CacheResultsInMemory=True,
    CacheSolveResults=True,
    RemoteDefinitionLocation="http://127.0.0.1:5000/test",
    RemoteSolveVersion=(0, 1, 0),
    ShowInput_Enabled=False,
    ShowInput_Path=False,
    SynchronousSolve=True)
pointat = Hops(
    Curve=reparameterize(line),
    T=number_slider_2,
    CacheResultsInMemory=True,
    CacheSolveResults=True,
    RemoteDefinitionLocation="http://127.0.0.1:5000/pointat",
    RemoteSolveVersion=(0, 1, 0),
    ShowInput_Enabled=False,
    ShowInput_Path=False,
    SynchronousSolve=True)
pointat_2 = Hops(
    Curve=reparameterize(curve),
    T=number_slider_2,
    CacheResultsInMemory=False,
    CacheSolveResults=False,
    RemoteDefinitionLocation="http://127.0.0.1:5000/pointat",
    RemoteSolveVersion=(0, 1, 0),
    ShowInput_Enabled=False,
    ShowInput_Path=False,
    SynchronousSolve=True)
# Examples Wickerson Studios
curve_end_points_2 = Hops(
    Curve=reparameterize(line),
    CacheResultsInMemory=False,
    CacheSolveResults=False,
    RemoteDefinitionLocation="http://127.0.0.1:5000/curve_end_points",
    RemoteSolveVersion=(0, 1, 0),
    ShowInput_Enabled=False,
    ShowInput_Path=False,
    SynchronousSolve=True)  # -> S, E
srf4pt = Hops(
    CornerA=curve_end_points.S,
    CornerB=pointat_2,
    CornerC=curve_end_points_2.S,
    CornerD=pointat,
    CacheResultsInMemory=False,
    CacheSolveResults=False,
    RemoteDefinitionLocation="http://127.0.0.1:5000/srf4pt",
    RemoteSolveVersion=(0, 1, 0),
    ShowInput_Enabled=False,
    ShowInput_Path=False,
    SynchronousSolve=True)

# ----
# STRING
# methods:
# \t \n \s
# + concatenate
# len
# upper
# lower
# split
# join
# replace
# strip
# startswith
# endswith
# find
# count
# index
panel_3 = Panel("Michael Wickerson")
panel_4 = Panel()
strings = Hops(
    A=panel_4,
    B=panel_3,
    CacheResultsInMemory=False,
    CacheSolveResults=False,
    RemoteDefinitionLocation="http://127.0.0.1:5000/strings",
    RemoteSolveVersion=(0, 1, 0),
    ShowInput_Enabled=False,
    ShowInput_Path=False,
    SynchronousSolve=True)  # -> A, Concat, Length, Upper, Lower, Split, Join, Replace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
panel_5 = Panel([strings.A, strings.Concat, strings.Length, strings.Upper, strings.Lower, strings.Split, strings.Join, strings.Replace, strings.Strip, strings.Startswith, strings.Endswith, strings.Find, strings.Count, strings.Index])

# ----
# LISTS
# methods:
# /insert #bug
# /remove
# /sort
# /reverse
# /index #bug
number_slider_3 = Slider(10, range=0..10)
series = Series(Start=0, Step=1, Count=number_slider_3)
series_2 = Series(Start=0, Step=1, Count=Slider(10, range=0..10))
series_3 = Series(Start=0, Step=1, Count=Slider(10, range=0..10))
series_4 = Series(Start=0, Step=1, Count=Slider(10, range=0..10))
series_5 = Series(Start=0, Step=1, Count=Slider(10, range=0..10))
jitter = Jitter(List=series, Jitter=1, Seed=2)  # -> Values, Indices
index = Hops(
    NumList=series_2,
    Index=Slider(3, range=0..10),
    CacheResultsInMemory=True,
    CacheSolveResults=True,
    RemoteDefinitionLocation="http://127.0.0.1:5000/index",
    RemoteSolveVersion=(0, 1, 0),
    ShowInput_Enabled=False,
    ShowInput_Path=False,
    SynchronousSolve=True)
panel_6 = Panel(series_3)
remove = Hops(
    NumList=series_5,
    RemoveNum=Slider(3, range=0..10),
    CacheResultsInMemory=True,
    CacheSolveResults=True,
    RemoteDefinitionLocation="http://127.0.0.1:5000/remove",
    RemoteSolveVersion=(0, 1, 0),
    ShowInput_Enabled=False,
    ShowInput_Path=False,
    SynchronousSolve=True)
insert = Hops(
    NumList=series_4,
    InsertNum=Slider(29, range=0..100),
    Index=Slider(2, range=0..10),
    CacheResultsInMemory=True,
    CacheSolveResults=True,
    RemoteDefinitionLocation="http://127.0.0.1:5000/insert",
    RemoteSolveVersion=(0, 1, 0),
    ShowInput_Enabled=False,
    ShowInput_Path=False,
    SynchronousSolve=True)
reverse = Hops(
    NumList=panel_6,
    CacheResultsInMemory=True,
    CacheSolveResults=True,
    RemoteDefinitionLocation="http://127.0.0.1:5000/reverse",
    RemoteSolveVersion=(0, 1, 0),
    ShowInput_Enabled=False,
    ShowInput_Path=False,
    SynchronousSolve=True)
sort = Hops(
    NumList=jitter.Values,
    CacheResultsInMemory=True,
    CacheSolveResults=True,
    RemoteDefinitionLocation="http://127.0.0.1:5000/sort",
    RemoteSolveVersion=(0, 1, 0),
    ShowInput_Enabled=False,
    ShowInput_Path=False,
    SynchronousSolve=True)
panel_7 = Panel(index)
panel_8 = Panel(reverse)
panel_9 = Panel(insert)
panel_10 = Panel(remove)
panel_11 = Panel(sort)

# ----
# STACKS
# methods:
# /append
# /pop
number_slider_4 = Slider(10, range=0..10)
series_6 = Series(Start=0, Step=1, Count=number_slider_4)
series_7 = Series(Start=0, Step=1, Count=Slider(10, range=0..10))
panel_12 = Panel(series_6)
append = Hops(
    NumList=series_7,
    Num=Slider(3, range=0..10),
    CacheResultsInMemory=True,
    CacheSolveResults=True,
    RemoteDefinitionLocation="http://127.0.0.1:5000/append",
    RemoteSolveVersion=(0, 1, 0),
    ShowInput_Enabled=False,
    ShowInput_Path=False,
    SynchronousSolve=True)
pop = Hops(
    NumList=panel_12,
    CacheResultsInMemory=True,
    CacheSolveResults=True,
    RemoteDefinitionLocation="http://127.0.0.1:5000/pop",
    RemoteSolveVersion=(0, 1, 0),
    ShowInput_Enabled=False,
    ShowInput_Path=False,
    SynchronousSolve=True)
panel_13 = Panel(append)
panel_14 = Panel(pop)
