# Grasshopper definition PFHG_004(rhinoinside).gh (Grasshopper 1.0.7)
# plug-ins: Hops

circle = Circle(Plane=PlaneXY(0, 0, 0), Radius=Slider(13, range=0..100))
evaluate_curve = EvaluateCurve(Curve=reparameterize(circle), Parameter=[Slider(0.11, range=0..1), Slider(0.73, range=0..1), Slider(0.92, range=0..1)])  # -> Point, Tangent, Angle
explode_tree = ExplodeTree(Data=graft(evaluate_curve.Point))  # -> Branch0, Branch1, Branch2
hops = Hops(
    P1=explode_tree.Branch0,
    P2=explode_tree.Branch1,
    P3=explode_tree.Branch2,
    CacheResultsInMemory=False,
    CacheSolveResults=False,
    RemoteDefinitionLocation="http://127.0.0.1:5000/interplength",
    RemoteSolveVersion=(0, 1, 0),
    ShowInput_Enabled=False,
    ShowInput_Path=False,
    SynchronousSolve=True)
panel = Panel(hops)
