# Grasshopper definition PFHG_005.gh (Grasshopper 1.0.7)
# plug-ins: Hops

# ----
# PFHG_004.py
# Examples on McNeel
# install matplotlib
number_slider = Slider(10, range=0..10)
curve = Curve(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)
number_slider_2 = Slider(0.49, range=0..1)
# FLASK | HOPS | PYTHON 3 | GRASSHOPPER
curve_end_points = Hops(
    Curve=reparameterize(curve),
    CacheResultsInMemory=False,
    CacheSolveResults=False,
    RemoteDefinitionLocation="http://127.0.0.1:5000/curve_end_points",
    RemoteSolveVersion=(0, 1, 0),
    ShowInput_Enabled=False,
    ShowInput_Path=False,
    SynchronousSolve=True)  # -> S, E
range = Range(Domain=Domain(0, 1), Steps=number_slider)
unit_z = UnitZ(Factor=Slider(16, range=0..100))
square = Square(Plane=PlaneXY(0, 0, 0), Size=1, ExtentX=5, ExtentY=5)  # -> Cells, Points
point = Point([curve_end_points.S, curve_end_points.E])
square_2 = Square(Plane=PlaneXY(0, 0, 0), Size=1, ExtentX=5, ExtentY=5)  # -> Cells, flatten(Points)
boolean_toggle = BooleanToggle(False)
move = Move(Geometry=point, Motion=unit_z)  # -> Geometry, Transform
pointsat = Hops(
    Curve=reparameterize(curve),
    T=range,
    CacheResultsInMemory=True,
    CacheSolveResults=True,
    RemoteDefinitionLocation="http://127.0.0.1:5000/pointsat",
    RemoteSolveVersion=(0, 1, 0),
    ShowInput_Enabled=False,
    ShowInput_Path=False,
    SynchronousSolve=True)
panel = Panel(square.Points)
delaunay_mesh = DelaunayMesh(Points=square_2.Points, Plane=PlaneXY(0, 0, 0))
panel_2 = Panel(pointsat)
dispatch = Dispatch(List=flatten(move.Geometry), DispatchPattern=[True, False])  # -> ListA, ListB
deconstruct_mesh = DeconstructMesh(Mesh=delaunay_mesh)  # -> Vertices, Faces, Colours, Normals
line = Line(StartPoint=dispatch.ListB, EndPoint=dispatch.ListA)
hops = Hops(
    Points=deconstruct_mesh.Vertices,
    Integer=Slider(0, range=0..100),
    CacheResultsInMemory=True,
    CacheSolveResults=True,
    RemoteDefinitionLocation="http://127.0.0.1:5000/test",
    RemoteSolveVersion=(0, 1, 0),
    ShowInput_Enabled=False,
    ShowInput_Path=False,
    SynchronousSolve=True)
pointat = Hops(
    Curve=reparameterize(line),
    T=number_slider_2,
    CacheResultsInMemory=True,
    CacheSolveResults=True,
    RemoteDefinitionLocation="http://127.0.0.1:5000/pointat",
    RemoteSolveVersion=(0, 1, 0),
    ShowInput_Enabled=False,
    ShowInput_Path=False,
    SynchronousSolve=True)
pointat_2 = Hops(
    Curve=reparameterize(curve),
    T=number_slider_2,
    CacheResultsInMemory=False,
    CacheSolveResults=False,
    RemoteDefinitionLocation="http://127.0.0.1:5000/pointat",
    RemoteSolveVersion=(0, 1, 0),
    ShowInput_Enabled=False,
    ShowInput_Path=False,
    SynchronousSolve=True)
curve_end_points_2 = Hops(
    Curve=reparameterize(line),
    CacheResultsInMemory=False,
    CacheSolveResults=False,
    RemoteDefinitionLocation="http://127.0.0.1:5000/curve_end_points",
    RemoteSolveVersion=(0, 1, 0),
    ShowInput_Enabled=False,
    ShowInput_Path=False,
    SynchronousSolve=True)  # -> S, E
srf4pt = Hops(
    CornerA=curve_end_points.S,
    CornerB=pointat_2,
    CornerC=curve_end_points_2.S,
    CornerD=pointat,
    CacheResultsInMemory=False,
    CacheSolveResults=False,
    RemoteDefinitionLocation="http://127.0.0.1:5000/srf4pt",
    RemoteSolveVersion=(0, 1, 0),
    ShowInput_Enabled=False,
    ShowInput_Path=False,
    SynchronousSolve=True)

# ----
# Examples Wickerson Studios
# TUPLES:
# SETS:
# DICTIONARIES:
# CONTROL FLOW
# IN PYTHON:
# /forloop
# /_digitSum
# /nested_If
# /if-elif-else
number_slider_3 = Slider(4, range=0..10)
series = Series(Start=0, Step=1, Count=10)
series_2 = Series(Start=0, Step=1, Count=10)
panel_3 = Panel(series)
forloop = Hops(
    NumList=series_2,
    CacheResultsInMemory=True,
    CacheSolveResults=True,
    RemoteDefinitionLocation="http://127.0.0.1:5000/forloop",
    RemoteSolveVersion=(0, 1, 0),
    ShowInput_Enabled=False,
    ShowInput_Path=False,
    SynchronousSolve=True)
series_3 = Series(Start=number_slider_3, Step=Slider(5, range=0..10), Count="2")
series_4 = Series(Start=Slider(0, range=0..10), Step=Slider(0, range=0..10), Count="2")
digitsum = Hops(
    Num=panel_3,
    CacheResultsInMemory=True,
    CacheSolveResults=True,
    RemoteDefinitionLocation="http://127.0.0.1:5000/_digitSum",
    RemoteSolveVersion=(0, 1, 0),
    ShowInput_Enabled=False,
    ShowInput_Path=False,
    SynchronousSolve=True)
panel_4 = Panel(series_3)
panel_5 = Panel(series_4)
panel_6 = Panel(forloop)
panel_7 = Panel(digitsum)
nested_if = Hops(
    Num=panel_4,
    CacheResultsInMemory=True,
    CacheSolveResults=True,
    RemoteDefinitionLocation="http://127.0.0.1:5000/nested_If",
    RemoteSolveVersion=(0, 1, 0),
    ShowInput_Enabled=False,
    ShowInput_Path=False,
    SynchronousSolve=True)
entwine = Entwine(Branch00=panel_5, Branch01="8", FlattenInputs=True)  # -> flatten(Result)
panel_8 = Panel(nested_if)
panel_9 = Panel(entwine)
if_elif_else = Hops(
    Num=panel_9,
    CacheResultsInMemory=True,
    CacheSolveResults=True,
    RemoteDefinitionLocation="http://127.0.0.1:5000/if-elif-else",
    RemoteSolveVersion=(0, 1, 0),
    ShowInput_Enabled=False,
    ShowInput_Path=False,
    SynchronousSolve=True)
panel_10 = Panel(if_elif_else)

# ----
# LOOPS:
# /while
# /range
# /while-count
# /while-pop
# /_while-break
number_slider_4 = Slider(0, range=0..10)
series_5 = Series(Start=Slider(0, range=0..10), Step=Slider(10, range=0..10), Count=Slider(10, range=0..10))
series_6 = Series(Start=0, Step=1, Count=Slider(10, range=0..10))
series_7 = Series(Start=Slider(0, range=0..10), Step=Slider(1, range=0..10), Count=Slider(10, range=0..10))
series_8 = Series(Start=Slider(4, range=0..10), Step=Slider(5, range=0..10), Count=Slider(7, range=0..10))
series_9 = Series(Start=number_slider_4, Step=Slider(1, range=0..10), Count=Slider(10, range=0..10))
panel_11 = Panel(series_8)
panel_12 = Panel(series_9)
panel_13 = Panel(series_7)
panel_14 = Panel(series_5)
panel_15 = Panel(series_6)
while = Hops(
    Num=panel_12,
    CacheResultsInMemory=True,
    CacheSolveResults=True,
    RemoteDefinitionLocation="http://127.0.0.1:5000/while",
    RemoteSolveVersion=(0, 1, 0),
    ShowInput_Enabled=False,
    ShowInput_Path=False,
    SynchronousSolve=True)
while_count = Hops(
    Num=panel_11,
    CacheResultsInMemory=True,
    CacheSolveResults=True,
    RemoteDefinitionLocation="http://127.0.0.1:5000/while-count",
    RemoteSolveVersion=(0, 1, 0),
    ShowInput_Enabled=False,
    ShowInput_Path=False,
    SynchronousSolve=True)
while_pop = Hops(
    Num=panel_14,
    CacheResultsInMemory=True,
    CacheSolveResults=True,
    RemoteDefinitionLocation="http://127.0.0.1:5000/while-pop",
    RemoteSolveVersion=(0, 1, 0),
    ShowInput_Enabled=False,
    ShowInput_Path=False,
    SynchronousSolve=True)
range_2 = Hops(
    Num=panel_13,
    CacheResultsInMemory=True,
    CacheSolveResults=True,
    RemoteDefinitionLocation="http://127.0.0.1:5000/range",
    RemoteSolveVersion=(0, 1, 0),
    ShowInput_Enabled=False,
    ShowInput_Path=False,
    SynchronousSolve=True)
while_break = Hops(
    Num=panel_15,
    BreakNum=Slider(0, range=0..10),
    CacheResultsInMemory=False,
    CacheSolveResults=False,
    RemoteDefinitionLocation="http://127.0.0.1:5000/_while-break",
    RemoteSolveVersion=(0, 1, 0),
    ShowInput_Enabled=False,
    ShowInput_Path=False,
    SynchronousSolve=True)
panel_16 = Panel(while)
panel_17 = Panel(while_pop)
panel_18 = Panel(while_count)
panel_19 = Panel(range_2)
panel_20 = Panel(while_break)

# ----
# MISCELLANEOUS
# functions
# /is_prime
# /evenOdd
# /swap
number_slider_5 = Slider(10, range=0..10)
series_10 = Series(Start=0, Step=1, Count=number_slider_5)
evenodd = Hops(
    Num=Slider(14, range=0..100),
    CacheResultsInMemory=True,
    CacheSolveResults=True,
    RemoteDefinitionLocation="http://127.0.0.1:5000/evenOdd",
    RemoteSolveVersion=(0, 1, 0),
    ShowInput_Enabled=False,
    ShowInput_Path=False,
    SynchronousSolve=True)
swap = Hops(
    NumList=series_10,
    Index1=Slider(0, range=0..10),
    Index2=Slider(9, range=0..9),
    CacheResultsInMemory=True,
    CacheSolveResults=True,
    RemoteDefinitionLocation="http://127.0.0.1:5000/_swap",
    RemoteSolveVersion=(0, 1, 0),
    ShowInput_Enabled=False,
    ShowInput_Path=False,
    SynchronousSolve=True)
is_prime = Hops(
    Num=Slider(23, range=0..100),
    CacheResultsInMemory=False,
    CacheSolveResults=False,
    RemoteDefinitionLocation="http://127.0.0.1:5000/is_prime",
    RemoteSolveVersion=(0, 1, 0),
    ShowInput_Enabled=False,
    ShowInput_Path=False,
    SynchronousSolve=True)
panel_21 = Panel(is_prime)
panel_22 = Panel(evenodd)
panel_23 = Panel(swap)

# ----
# ANNONYMOUS FUNCTIONS
# lambda functions:
# /cube
number_slider_6 = Slider(2, range=0..10)
cube = Hops(
    Num=number_slider_6,
    CacheResultsInMemory=True,
    CacheSolveResults=True,
    RemoteDefinitionLocation="http://127.0.0.1:5000/cube",
    RemoteSolveVersion=(0, 1, 0),
    ShowInput_Enabled=False,
    ShowInput_Path=False,
    SynchronousSolve=True)
panel_24 = Panel(cube)
