# Grasshopper definition PFHG_006.gh (Grasshopper 1.0.7)
# plug-ins: Hops

# ----
# PFHG_004.py
# Examples on McNeel
# install matplotlib
number_slider = Slider(10, range=0..10)
curve = Curve(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)
number_slider_2 = Slider(0.49, range=0..1)
# FLASK | HOPS | PYTHON 3 | GRASSHOPPER
curve_end_points = Hops(
    Curve=reparameterize(curve),
    CacheResultsInMemory=False,
    CacheSolveResults=False,
    RemoteDefinitionLocation="http://127.0.0.1:5000/curve_end_points",
    RemoteSolveVersion=(0, 1, 0),
    ShowInput_Enabled=False,
    ShowInput_Path=False,
    SynchronousSolve=True)  # -> S, E
range = Range(Domain=Domain(0, 1), Steps=number_slider)
unit_z = UnitZ(Factor=Slider(16, range=0..100))
square = Square(Plane=PlaneXY(0, 0, 0), Size=1, ExtentX=5, ExtentY=5)  # -> Cells, Points
point = Point([curve_end_points.S, curve_end_points.E])
square_2 = Square(Plane=PlaneXY(0, 0, 0), Size=1, ExtentX=5, ExtentY=5)  # -> Cells, flatten(Points)
boolean_toggle = BooleanToggle(False)
move = Move(Geometry=point, Motion=unit_z)  # -> Geometry, Transform
pointsat = Hops(
    Curve=reparameterize(curve),
    T=range,
    CacheResultsInMemory=True,
    CacheSolveResults=True,
    RemoteDefinitionLocation="http://127.0.0.1:5000/pointsat",
    RemoteSolveVersion=(0, 1, 0),
    ShowInput_Enabled=False,
    ShowInput_Path=False,
    SynchronousSolve=True)
panel = Panel(square.Points)
delaunay_mesh = DelaunayMesh(Points=square_2.Points, Plane=PlaneXY(0, 0, 0))
panel_2 = Panel(pointsat)
dispatch = Dispatch(List=flatten(move.Geometry), DispatchPattern=[True, False])  # -> ListA, ListB
deconstruct_mesh = DeconstructMesh(Mesh=delaunay_mesh)  # -> Vertices, Faces, Colours, Normals
line = Line(StartPoint=dispatch.ListB, EndPoint=dispatch.ListA)
test = Hops(
    Points=deconstruct_mesh.Vertices,
    Integer=Slider(0, range=0..100),
    CacheResultsInMemory=True,
    CacheSolveResults=True,
    RemoteDefinitionLocation="http://127.0.0.1:5000/test",
    RemoteSolveVersion=(0, 1, 0),
    ShowInput_Enabled=False,
    ShowInput_Path=False,
    SynchronousSolve=True)
pointat = Hops(
    Curve=reparameterize(line),
    T=number_slider_2,
    CacheResultsInMemory=True,
    CacheSolveResults=True,
    RemoteDefinitionLocation="http://127.0.0.1:5000/pointat",
    RemoteSolveVersion=(0, 1, 0),
    ShowInput_Enabled=False,
    ShowInput_Path=False,
    SynchronousSolve=True)
pointat_2 = Hops(
    Curve=reparameterize(curve),
    T=number_slider_2,
    CacheResultsInMemory=False,
    CacheSolveResults=False,
    RemoteDefinitionLocation="http://127.0.0.1:5000/pointat",
    RemoteSolveVersion=(0, 1, 0),
    ShowInput_Enabled=False,
    ShowInput_Path=False,
    SynchronousSolve=True)
curve_end_points_2 = Hops(
    Curve=reparameterize(line),
    CacheResultsInMemory=False,
    CacheSolveResults=False,
    RemoteDefinitionLocation="http://127.0.0.1:5000/curve_end_points",
    RemoteSolveVersion=(0, 1, 0),
    ShowInput_Enabled=False,
    ShowInput_Path=False,
    SynchronousSolve=True)  # -> S, E
srf4pt = Hops(
    CornerA=curve_end_points.S,
    CornerB=pointat_2,
    CornerC=curve_end_points_2.S,
    CornerD=pointat,
    CacheResultsInMemory=False,
    CacheSolveResults=False,
    RemoteDefinitionLocation="http://127.0.0.1:5000/srf4pt",
    RemoteSolveVersion=(0, 1, 0),
    ShowInput_Enabled=False,
    ShowInput_Path=False,
    SynchronousSolve=True)

# ----
# Examples Wickerson Studios
# TUPLES:
# SETS:
# DICTIONARIES:
# CONTROL FLOW
# IN PYTHON:
# /forloop
# /_digitSum
# /nested_If
# /if-elif-else
number_slider_3 = Slider(4, range=0..10)
series = Series(Start=0, Step=1, Count=10)
series_2 = Series(Start=0, Step=1, Count=10)
panel_3 = Panel(series)
forloop = Hops(
    NumList=series_2,
    CacheResultsInMemory=True,
    CacheSolveResults=True,
    RemoteDefinitionLocation="http://127.0.0.1:5000/forloop",
    RemoteSolveVersion=(0, 1, 0),
    ShowInput_Enabled=False,
    ShowInput_Path=False,
    SynchronousSolve=True)
series_3 = Series(Start=number_slider_3, Step=Slider(5, range=0..10), Count="2")
series_4 = Series(Start=Slider(0, range=0..10), Step=Slider(4, range=0..10), Count="2")
digitsum = Hops(
    Num=panel_3,
    CacheResultsInMemory=True,
    CacheSolveResults=True,
    RemoteDefinitionLocation="http://127.0.0.1:5000/_digitSum",
    RemoteSolveVersion=(0, 1, 0),
    ShowInput_Enabled=False,
    ShowInput_Path=False,
    SynchronousSolve=True)
panel_4 = Panel(series_3)
panel_5 = Panel(series_4)
panel_6 = Panel(forloop)
panel_7 = Panel(digitsum)
nested_if = Hops(
    Num=panel_4,
    CacheResultsInMemory=False,
    CacheSolveResults=False,
    RemoteDefinitionLocation="http://127.0.0.1:5000/nested_If",
    RemoteSolveVersion=(0, 1, 0),
    ShowInput_Enabled=False,
    ShowInput_Path=False,
    SynchronousSolve=True)
entwine = Entwine(Branch00=panel_5, Branch01="8", FlattenInputs=True)  # -> flatten(Result)
panel_8 = Panel(nested_if)
panel_9 = Panel(entwine)
if_elif_else = Hops(
    Num=panel_9,
    CacheResultsInMemory=True,
    CacheSolveResults=True,
    RemoteDefinitionLocation="http://127.0.0.1:5000/if-elif-else",
    RemoteSolveVersion=(0, 1, 0),
    ShowInput_Enabled=False,
    ShowInput_Path=False,
    SynchronousSolve=True)
panel_10 = Panel(if_elif_else)

# ----
# LOOPS:
# /while
# /range
# /while-count
# /while-pop
# /_while-break
# /continue
# /sorted2
# /sorted_set2
# /_reversed
# /rangeComponent #camelCase
# /reversed_rangeComponent
number_slider_4 = Slider(4, range=0..10)
series_5 = Series(Start=Slider(2, range=0..10), Step=1, Count=number_slider_4)
series_6 = Series(Start=0, Step=1, Count=Slider(4, range=0..10))
entwine_2 = Entwine(Branch00=series_6, Branch01=series_5, FlattenInputs=True)  # -> flatten(Result)
series_7 = Series(Start=0, Step=1, Count=Slider(4, range=0..10))
number_slider_5 = Slider(10, range=0..10)
number_slider_6 = Slider(2, range=0..10)
number_slider_7 = Slider(2, range=0..10)
series_8 = Series(Start=0, Step=1, Count=Slider(4, range=0..10))
series_9 = Series(Start=Slider(0, range=0..10), Step=Slider(10, range=0..10), Count=Slider(4, range=0..10))
series_10 = Series(Start=0, Step=1, Count=Slider(10, range=0..10))
series_11 = Series(Start=Slider(0, range=0..10), Step=Slider(1, range=0..10), Count=Slider(10, range=0..10))
series_12 = Series(Start=Slider(4, range=0..10), Step=Slider(5, range=0..10), Count=Slider(7, range=0..10))
series_13 = Series(Start=Slider(0, range=0..10), Step=Slider(1, range=0..10), Count=Slider(10, range=0..10))
jitter = Jitter(List=series_7, Jitter=1, Seed=2)  # -> Values, Indices
jitter_2 = Jitter(List=entwine_2, Jitter=1, Seed=2)  # -> Values, Indices
panel_11 = Panel(series_12)
panel_12 = Panel(series_13)
panel_13 = Panel(jitter_2.Values)
panel_14 = Panel(jitter_2.Values)
panel_15 = Panel(series_8)
panel_16 = Panel(jitter.Values)
panel_17 = Panel(series_11)
panel_18 = Panel(series_9)
panel_19 = Panel(series_10)
while = Hops(
    Num=panel_12,
    CacheResultsInMemory=True,
    CacheSolveResults=True,
    RemoteDefinitionLocation="http://127.0.0.1:5000/while",
    RemoteSolveVersion=(0, 1, 0),
    ShowInput_Enabled=False,
    ShowInput_Path=False,
    SynchronousSolve=True)
while_count = Hops(
    Num=panel_11,
    CacheResultsInMemory=True,
    CacheSolveResults=True,
    RemoteDefinitionLocation="http://127.0.0.1:5000/while-count",
    RemoteSolveVersion=(0, 1, 0),
    ShowInput_Enabled=False,
    ShowInput_Path=False,
    SynchronousSolve=True)
rangecomponent = Hops(
    Start=number_slider_7,
    End=number_slider_5,
    Step=number_slider_6,
    CacheResultsInMemory=True,
    CacheSolveResults=True,
    RemoteDefinitionLocation="http://127.0.0.1:5000/_rangeComponent",
    RemoteSolveVersion=(0, 1, 0),
    ShowInput_Enabled=False,
    ShowInput_Path=False,
    SynchronousSolve=True)
range_2 = Hops(
    Num=panel_17,
    CacheResultsInMemory=True,
    CacheSolveResults=True,
    RemoteDefinitionLocation="http://127.0.0.1:5000/range",
    RemoteSolveVersion=(0, 1, 0),
    ShowInput_Enabled=False,
    ShowInput_Path=False,
    SynchronousSolve=True)
raversed_rangecomponent = Hops(
    Start=number_slider_7,
    End=number_slider_5,
    Step=number_slider_6,
    CacheResultsInMemory=True,
    CacheSolveResults=True,
    RemoteDefinitionLocation="http://127.0.0.1:5000/reversed_rangeComponent",
    RemoteSolveVersion=(0, 1, 0),
    ShowInput_Enabled=False,
    ShowInput_Path=False,
    SynchronousSolve=True)
whilepop = Hops(
    Num=panel_18,
    CacheResultsInMemory=True,
    CacheSolveResults=True,
    RemoteDefinitionLocation="http://127.0.0.1:5000/whilepop",
    RemoteSolveVersion=(0, 1, 0),
    ShowInput_Enabled=False,
    ShowInput_Path=False,
    SynchronousSolve=True)
continue = Hops(
    Num=panel_15,
    ContinueNum=Slider(0, range=0..10),
    CacheResultsInMemory=True,
    CacheSolveResults=True,
    RemoteDefinitionLocation="http://127.0.0.1:5000/continue",
    RemoteSolveVersion=(0, 1, 0),
    ShowInput_Enabled=False,
    ShowInput_Path=False,
    SynchronousSolve=True)
reversed = Hops(
    Num=panel_14,
    CacheResultsInMemory=True,
    CacheSolveResults=True,
    RemoteDefinitionLocation="http://127.0.0.1:5000/_reversed",
    RemoteSolveVersion=(0, 1, 0),
    ShowInput_Enabled=False,
    ShowInput_Path=False,
    SynchronousSolve=True)
sorted2 = Hops(
    Num=panel_16,
    CacheResultsInMemory=True,
    CacheSolveResults=True,
    RemoteDefinitionLocation="http://127.0.0.1:5000/sorted2",
    RemoteSolveVersion=(0, 1, 0),
    ShowInput_Enabled=False,
    ShowInput_Path=False,
    SynchronousSolve=True)
sorted_set2 = Hops(
    Num=panel_13,
    CacheResultsInMemory=True,
    CacheSolveResults=True,
    RemoteDefinitionLocation="http://127.0.0.1:5000/sorted_set2",
    RemoteSolveVersion=(0, 1, 0),
    ShowInput_Enabled=False,
    ShowInput_Path=False,
    SynchronousSolve=True)
while_break = Hops(
    Num=panel_19,
    BreakNum=Slider(0, range=0..10),
    CacheResultsInMemory=False,
    CacheSolveResults=False,
    RemoteDefinitionLocation="http://127.0.0.1:5000/_while-break",
    RemoteSolveVersion=(0, 1, 0),
    ShowInput_Enabled=False,
    ShowInput_Path=False,
    SynchronousSolve=True)
panel_20 = Panel(while)
panel_21 = Panel(whilepop)
panel_22 = Panel(while_count)
panel_23 = Panel(range_2)
panel_24 = Panel(sorted2)
panel_25 = Panel(sorted_set2)
panel_26 = Panel(raversed_rangecomponent)
panel_27 = Panel(reversed)
panel_28 = Panel(rangecomponent)
panel_29 = Panel(continue)
panel_30 = Panel(while_break)

# ----
# LOOPING TECH.
# /_enumerate # like panel
# /zip # like weave
number_slider_8 = Slider(2, range=0..10)
number_slider_9 = Slider(4, range=0..10)
series_14 = Series(Start=0, Step=1, Count=10)
series_15 = Series(Start=0, Step=1, Count=number_slider_9)
series_16 = Series(Start=number_slider_8, Step=number_slider_8, Count=number_slider_9)
panel_31 = Panel(series_14)
panel_32 = Panel(series_15)
panel_33 = Panel(series_16)
enumerate = Hops(
    Num=panel_31,
    CacheResultsInMemory=True,
    CacheSolveResults=True,
    RemoteDefinitionLocation="http://127.0.0.1:5000/_enumerate",
    RemoteSolveVersion=(0, 1, 0),
    ShowInput_Enabled=False,
    ShowInput_Path=False,
    SynchronousSolve=True)
zip = Hops(
    Num=panel_32,
    Num2=panel_33,
    CacheResultsInMemory=True,
    CacheSolveResults=True,
    RemoteDefinitionLocation="http://127.0.0.1:5000/zip",
    RemoteSolveVersion=(0, 1, 0),
    ShowInput_Enabled=False,
    ShowInput_Path=False,
    SynchronousSolve=True)
panel_34 = Panel(enumerate)
panel_35 = Panel(zip)

# ----
# MISCELLANEOUS
# functions
# /is_prime
# /evenOdd
# /swap
number_slider_10 = Slider(10, range=0..10)
series_17 = Series(Start=0, Step=1, Count=number_slider_10)
evenodd = Hops(
    Num=Slider(14, range=0..100),
    CacheResultsInMemory=True,
    CacheSolveResults=True,
    RemoteDefinitionLocation="http://127.0.0.1:5000/evenOdd",
    RemoteSolveVersion=(0, 1, 0),
    ShowInput_Enabled=False,
    ShowInput_Path=False,
    SynchronousSolve=True)
swap = Hops(
    NumList=series_17,
    Index1=Slider(2, range=0..10),
    Index2=Slider(9, range=0..9),
    CacheResultsInMemory=True,
    CacheSolveResults=True,
    RemoteDefinitionLocation="http://127.0.0.1:5000/_swap",
    RemoteSolveVersion=(0, 1, 0),
    ShowInput_Enabled=False,
    ShowInput_Path=False,
    SynchronousSolve=True)
is_prime = Hops(
    Num=Slider(23, range=0..100),
    CacheResultsInMemory=False,
    CacheSolveResults=False,
    RemoteDefinitionLocation="http://127.0.0.1:5000/is_prime",
    RemoteSolveVersion=(0, 1, 0),
    ShowInput_Enabled=False,
    ShowInput_Path=False,
    SynchronousSolve=True)
panel_36 = Panel(evenodd)
panel_37 = Panel(swap)

# ----
# ANNONYMOUS FUNCTIONS
# lambda functions:
# /cube
# /power
# 
# # trouble my lambda functions
number_slider_11 = Slider(3, range=0..10)
power = Hops(
    Num=Slider(3, range=0..10),
    Power=number_slider_11,
    CacheResultsInMemory=True,
    CacheSolveResults=True,
    RemoteDefinitionLocation="http://127.0.0.1:5000/power",
    RemoteSolveVersion=(0, 1, 0),
    ShowInput_Enabled=False,
    ShowInput_Path=False,
    SynchronousSolve=True)
cube1 = Hops(
    Num=Slider(3, range=0..10),
    CacheResultsInMemory=True,
    CacheSolveResults=True,
    RemoteDefinitionLocation="http://127.0.0.1:5000/cube1",
    RemoteSolveVersion=(0, 1, 0),
    ShowInput_Enabled=False,
    ShowInput_Path=False,
    SynchronousSolve=True)
panel_38 = Panel(cube1)
panel_39 = Panel(power)

# ----
# LIST COMPREHENSION:
# lambda functions:
# /_filter1
# /_map3
number_slider_12 = Slider(22, range=0..100)
series_18 = Series(Start=0, Step=1, Count=number_slider_12)
series_19 = Series(Start=0, Step=1, Count=Slider(17, range=0..100))
jitter_3 = Jitter(List=series_18, Jitter=1, Seed=2)  # -> Values, Indices
jitter_4 = Jitter(List=series_19, Jitter=1, Seed=2)  # -> Values, Indices
panel_40 = Panel(jitter_4.Values)
panel_41 = Panel(jitter_3.Values)
filter1 = Hops(
    NumList=panel_41,
    CacheResultsInMemory=True,
    CacheSolveResults=True,
    RemoteDefinitionLocation="http://127.0.0.1:5000/_filter1",
    RemoteSolveVersion=(0, 1, 0),
    ShowInput_Enabled=False,
    ShowInput_Path=False,
    SynchronousSolve=True)
map3 = Hops(
    NumList=panel_40,
    CacheResultsInMemory=True,
    CacheSolveResults=True,
    RemoteDefinitionLocation="http://127.0.0.1:5000/_map3",
    RemoteSolveVersion=(0, 1, 0),
    ShowInput_Enabled=False,
    ShowInput_Path=False,
    SynchronousSolve=True)
panel_42 = Panel(filter1)
panel_43 = Panel(map3)
