# Grasshopper definition PFHG_007.gh (Grasshopper 1.0.7)
# plug-ins: Hops

# ----
# Examples Wickerson Studios
# CLASSES AND
# OBJECTS:
# /class
# /classWithAttributes
number_slider = Slider(3, range=0..10)
# FLASK | HOPS | PYTHON 3 | GRASSHOPPER
# PFHG_007.gh
number_slider_2 = Slider(3, range=0..10)
classwithattributes = Hops(
    Num=number_slider,
    CacheResultsInMemory=True,
    CacheSolveResults=True,
    RemoteDefinitionLocation="http://127.0.0.1:5000/classWithAttributes",
    RemoteSolveVersion=(0, 1, 0),
    ShowInput_Enabled=False,
    ShowInput_Path=False,
    SynchronousSolve=True)  # -> Attr1Out, Attr2Out, InfoOut
class = Hops(
    Num=number_slider_2,
    CacheResultsInMemory=True,
    CacheSolveResults=True,
    RemoteDefinitionLocation="http://127.0.0.1:5000/class",
    RemoteSolveVersion=(0, 1, 0),
    ShowInput_Enabled=False,
    ShowInput_Path=False,
    SynchronousSolve=True)

panel = Panel(class)
panel_2 = Panel([classwithattributes.Attr1Out, classwithattributes.Attr2Out, classwithattributes.InfoOut])

# ----
# CLASSES ADV.
# 
# /class_calculator
# /class_calculator_adv
# /class_calculator_trig
# /class_calculator_trig_adv
number_slider_3 = Slider(0.1, range=0..10)
class_calculator_trig_adv = Hops(
    Num1=number_slider_3,
    Num2=Slider(0.23, range=0..10),
    CacheResultsInMemory=True,
    CacheSolveResults=True,
    RemoteDefinitionLocation="http://127.0.0.1:5000/class_calculator_trig_adv",
    RemoteSolveVersion=(0, 1, 0),
    ShowInput_Enabled=False,
    ShowInput_Path=False,
    SynchronousSolve=True)  # -> Asin, Acos, Atan, Atan2
class_calculator_trig = Hops(
    Num1=Slider(0.1, range=0..10),
    Num2=Slider(0.23, range=0..10),
    CacheResultsInMemory=True,
    CacheSolveResults=True,
    RemoteDefinitionLocation="http://127.0.0.1:5000/class_calculator_trig",
    RemoteSolveVersion=(0, 1, 0),
    ShowInput_Enabled=False,
    ShowInput_Path=False,
    SynchronousSolve=True)  # -> Sin, Cos, Tan
class_calculator_adv = Hops(
    Num1=Slider(2, range=0..10),
    Num2=Slider(1.78, range=0..10),
    CacheResultsInMemory=True,
    CacheSolveResults=True,
    RemoteDefinitionLocation="http://127.0.0.1:5000/class_calculator_adv",
    RemoteSolveVersion=(0, 1, 0),
    ShowInput_Enabled=False,
    ShowInput_Path=False,
    SynchronousSolve=True)  # -> Mod, Div, Exp, Pow
class_calculator = Hops(
    Num1=Slider(2.28, range=0..10),
    Num2=Slider(2, range=0..10),
    CacheResultsInMemory=True,
    CacheSolveResults=True,
    RemoteDefinitionLocation="http://127.0.0.1:5000/class_calculator",
    RemoteSolveVersion=(0, 1, 0),
    ShowInput_Enabled=False,
    ShowInput_Path=False,
    SynchronousSolve=True)  # -> Sum, Diff, Prod, Quot
panel_3 = Panel([class_calculator_trig.Sin, class_calculator_trig.Cos, class_calculator_trig.Tan])
panel_4 = Panel([class_calculator.Sum, class_calculator.Diff, class_calculator.Prod, class_calculator.Quot])
panel_5 = Panel([class_calculator_trig_adv.Asin, class_calculator_trig_adv.Acos, class_calculator_trig_adv.Atan, class_calculator_trig_adv.Atan2])
panel_6 = Panel([class_calculator_adv.Mod, class_calculator_adv.Div, class_calculator_adv.Exp, class_calculator_adv.Pow])

# ----
# CLASSES ADV.
# Parameterized Constructor:
number_slider_4 = Slider(0.1, range=0..10)
class_addition = Hops(
    Num1=number_slider_4,
    Num2=Slider(1.66, range=0..10),
    CacheResultsInMemory=True,
    CacheSolveResults=True,
    RemoteDefinitionLocation="http://127.0.0.1:5000/class_Addition",
    RemoteSolveVersion=(0, 1, 0),
    ShowInput_Enabled=False,
    ShowInput_Path=False,
    SynchronousSolve=True)
panel_7 = Panel(class_addition)

# ----
# CLASSES ADV.
# Inheritance:
# /Addition_inheritance  # nonsense example
# 
# /single_inherit
# /multiple_inherit
# /multilevel
# /hierarchical
# /hybrid
number_slider_5 = Slider(1.98, range=0..10)
multiple_inherit = Hops(
    Num1=Slider(1.98, range=0..10),
    Num2=Slider(5.04, range=0..10),
    CacheResultsInMemory=True,
    CacheSolveResults=True,
    RemoteDefinitionLocation="http://127.0.0.1:5000/multiple_inherit",
    RemoteSolveVersion=(0, 1, 0),
    ShowInput_Enabled=False,
    ShowInput_Path=False,
    SynchronousSolve=True)  # -> Sum, Product, AddAndProduct
hierarchical = Hops(
    Num1=Slider(2, range=0..10),
    Num2=Slider(4, range=0..10),
    CacheResultsInMemory=True,
    CacheSolveResults=True,
    RemoteDefinitionLocation="http://127.0.0.1:5000/hierarchical",
    RemoteSolveVersion=(0, 1, 0),
    ShowInput_Enabled=False,
    ShowInput_Path=False,
    SynchronousSolve=True)  # -> Sum, Product, AddAndProduct
hybrid = Hops(
    Num1=Slider(2, range=0..10),
    Num2=Slider(4, range=0..10),
    CacheResultsInMemory=True,
    CacheSolveResults=True,
    RemoteDefinitionLocation="http://127.0.0.1:5000/hybrid",
    RemoteSolveVersion=(0, 1, 0),
    ShowInput_Enabled=False,
    ShowInput_Path=False,
    SynchronousSolve=True)  # -> Sum, Product, AddAndProduct
single_inherit = Hops(
    Num1=number_slider_5,
    Num2=Slider(5.04, range=0..10),
    CacheResultsInMemory=True,
    CacheSolveResults=True,
    RemoteDefinitionLocation="http://127.0.0.1:5000/single_inherit",
    RemoteSolveVersion=(0, 1, 0),
    ShowInput_Enabled=False,
    ShowInput_Path=False,
    SynchronousSolve=True)  # -> Sum, Product
multilevel = Hops(
    Num1=Slider(2, range=0..10),
    Num2=Slider(4, range=0..10),
    CacheResultsInMemory=True,
    CacheSolveResults=True,
    RemoteDefinitionLocation="http://127.0.0.1:5000/multilevel",
    RemoteSolveVersion=(0, 1, 0),
    ShowInput_Enabled=False,
    ShowInput_Path=False,
    SynchronousSolve=True)
addition_inheritance = Hops(
    Num1=Slider(2.7, range=0..10),
    Num2=Slider(6.24, range=0..10),
    CacheResultsInMemory=True,
    CacheSolveResults=True,
    RemoteDefinitionLocation="http://127.0.0.1:5000/Addition_inheritance",
    RemoteSolveVersion=(0, 1, 0),
    ShowInput_Enabled=False,
    ShowInput_Path=False,
    SynchronousSolve=True)
panel_8 = Panel(addition_inheritance)
panel_9 = Panel([single_inherit.Sum, single_inherit.Product])
panel_10 = Panel([hybrid.Sum, hybrid.Product, hybrid.AddAndProduct])
panel_11 = Panel([multiple_inherit.Sum, multiple_inherit.Product, multiple_inherit.AddAndProduct])
panel_12 = Panel(multilevel)
panel_13 = Panel([hierarchical.Sum, hierarchical.Product, hierarchical.AddAndProduct])

# ----
# CLASSES ADV.
# encapsulation:
# /protected
# /private
number_slider_6 = Slider(2, range=0..10)
protected = Hops(
    Num1=number_slider_6,
    CacheResultsInMemory=True,
    CacheSolveResults=True,
    RemoteDefinitionLocation="http://127.0.0.1:5000/protected",
    RemoteSolveVersion=(0, 1, 0),
    ShowInput_Enabled=False,
    ShowInput_Path=False,
    SynchronousSolve=True)  # -> Sum, Square
private = Hops(
    Num1=Slider(2, range=0..10),
    CacheResultsInMemory=True,
    CacheSolveResults=True,
    RemoteDefinitionLocation="http://127.0.0.1:5000/private",
    RemoteSolveVersion=(0, 1, 0),
    ShowInput_Enabled=False,
    ShowInput_Path=False,
    SynchronousSolve=True)  # -> Sum, Square
panel_14 = Panel([protected.Sum, protected.Square])
panel_15 = Panel([private.Sum, private.Square])

# ----
# CLASSES ADV.
# polymorphism:
# /polymorphism
# /polymorphism_add
# /poly_calculator
# /method_override
panel_16 = Panel()
series = Series(Start=0, Step=1, Count=10)
number_slider_7 = Slider(2, range=0..10)
poly_calculator = Hops(
    Num1=Slider(1, range=0..10),
    Num2=Slider(3, range=0..10),
    Num3=Slider(2, range=0..10),
    Num4=Slider(4, range=0..10),
    CacheResultsInMemory=True,
    CacheSolveResults=True,
    RemoteDefinitionLocation="http://127.0.0.1:5000/poly_calculator",
    RemoteSolveVersion=(0, 1, 0),
    ShowInput_Enabled=False,
    ShowInput_Path=False,
    SynchronousSolve=True)  # -> Sum, Sum2, Product, Product2, Division, Division2, Subtraction, Subtraction2
method_override = Hops(
    Num1=Slider(0, range=0..10),
    Num2=Slider(1, range=0..10),
    Num3=Slider(2, range=0..10),
    CacheResultsInMemory=True,
    CacheSolveResults=True,
    RemoteDefinitionLocation="http://127.0.0.1:5000/method_override",
    RemoteSolveVersion=(0, 1, 0),
    ShowInput_Enabled=False,
    ShowInput_Path=False,
    SynchronousSolve=True)  # -> Calc1_add1, Calc1_add2, Calc2_add1, Calc2_add2, Calc3_add1, Calc3_add2
polymorphism_add = Hops(
    Num1=Slider(2, range=0..10),
    Num2=Slider(2, range=0..10),
    Num3=0,
    CacheResultsInMemory=True,
    CacheSolveResults=True,
    RemoteDefinitionLocation="http://127.0.0.1:5000/polymorphism_add",
    RemoteSolveVersion=(0, 1, 0),
    ShowInput_Enabled=False,
    ShowInput_Path=False,
    SynchronousSolve=True)  # -> Sum, Sum2
polymorphism = Hops(
    Str1=panel_16,
    Num1=series,
    CacheResultsInMemory=True,
    CacheSolveResults=True,
    RemoteDefinitionLocation="http://127.0.0.1:5000/polymorphism",
    RemoteSolveVersion=(0, 1, 0),
    ShowInput_Enabled=False,
    ShowInput_Path=False,
    SynchronousSolve=True)  # -> Len, Len2
panel_17 = Panel([method_override.Calc1_add1, method_override.Calc1_add2, method_override.Calc2_add1, method_override.Calc2_add2, method_override.Calc3_add1, method_override.Calc3_add2])
panel_18 = Panel([polymorphism.Len, polymorphism.Len2])
panel_19 = Panel([polymorphism_add.Sum, polymorphism_add.Sum2])
panel_20 = Panel([poly_calculator.Sum, poly_calculator.Product, poly_calculator.Division, poly_calculator.Subtraction])
panel_21 = Panel([poly_calculator.Sum2, poly_calculator.Product2, poly_calculator.Division2, poly_calculator.Subtraction2])
