# Grasshopper definition PFHG_008.gh (Grasshopper 1.0.7)
# plug-ins: Hops

# FLASK | HOPS | PYTHON 3 | GRASSHOPPER
# PFHG_008.gh
# Examples Wickerson Studios
# EXCEPTION HANDLING
# difference between
# Syntax Error and
# Exceptions:
# /_exception1
panel = Panel("1")
series = Series(Start=panel, Step=1, Count="3")
hops = Hops(
    NumList=series,
    Num1=Slider(1, range=0..10),
    CacheResultsInMemory=True,
    CacheSolveResults=True,
    RemoteDefinitionLocation="http://127.0.0.1:5000/_exception1",
    RemoteSolveVersion=(0, 1, 0),
    ShowInput_Enabled=False,
    ShowInput_Path=False,
    SynchronousSolve=True)
panel_2 = Panel(hops)
