# Grasshopper definition PFHG_009.gh (Grasshopper 1.0.7)
# plug-ins: Hops

# ----
# Examples Wickerson Studios
# FILE HANDLING
# /read_file
# /_read_file2
# /write_file
# /append_file
# /read_file_lines
# /read_file_read
number_slider = Slider(55, range=0..110)
write_file = Hops(
    File_name="vendor.txt",
    File_content="the rain in spain",
    CacheResultsInMemory=False,
    CacheSolveResults=False,
    RemoteDefinitionLocation="http://127.0.0.1:5000/write_file",
    RemoteSolveVersion=(0, 1, 0),
    ShowInput_Enabled=False,
    ShowInput_Path=False,
    SynchronousSolve=True)
append_file = Hops(
    File_name="vendor.txt",
    File_content="Michael Wickerson",
    CacheResultsInMemory=False,
    CacheSolveResults=False,
    RemoteDefinitionLocation="http://127.0.0.1:5000/append_file",
    RemoteSolveVersion=(0, 1, 0),
    ShowInput_Enabled=False,
    ShowInput_Path=False,
    SynchronousSolve=True)
read_file = Hops(
    File_name="vendor.txt",
    CacheResultsInMemory=False,
    CacheSolveResults=False,
    RemoteDefinitionLocation="http://127.0.0.1:5000/read_file",
    RemoteSolveVersion=(0, 1, 0),
    ShowInput_Enabled=False,
    ShowInput_Path=False,
    SynchronousSolve=True)
read_file2 = Hops(
    File_name="vendor.txt",
    CacheResultsInMemory=False,
    CacheSolveResults=False,
    RemoteDefinitionLocation="http://127.0.0.1:5000/_read_file2",
    RemoteSolveVersion=(0, 1, 0),
    ShowInput_Enabled=False,
    ShowInput_Path=False,
    SynchronousSolve=True)
read_file_lines = Hops(
    File_name="vendor.txt",
    CacheResultsInMemory=False,
    CacheSolveResults=False,
    RemoteDefinitionLocation="http://127.0.0.1:5000/read_file_lines",
    RemoteSolveVersion=(0, 1, 0),
    ShowInput_Enabled=False,
    ShowInput_Path=False,
    SynchronousSolve=True)
read_file_read = Hops(
    File_name="vendor_test.txt",
    NumChar=number_slider,
    CacheResultsInMemory=True,
    CacheSolveResults=True,
    RemoteDefinitionLocation="http://127.0.0.1:5000/read_file_read",
    RemoteSolveVersion=(0, 1, 0),
    ShowInput_Enabled=False,
    ShowInput_Path=False,
    SynchronousSolve=True)
# FLASK | HOPS | PYTHON 3 | GRASSHOPPER
# PFHG_009.gh
panel = Panel(read_file)
panel_2 = Panel(read_file2)
panel_3 = Panel(write_file)
panel_4 = Panel(append_file)
panel_5 = Panel(read_file_lines)
panel_6 = Panel(read_file_read)

# ----
# CREATING FILE
# USING WRITE MODE
# /create_file
# /apend_file_append
# /split_file
# /open_file
# /open_file_append
# /seek_file
# /tell_file
panel_7 = Panel("C:\Users\Sculpture\Desktop\my_file_Desktop.txt")
seek_file = Hops(
    File_name=panel_7,
    Seek_position=Slider(30, range=0..100),
    CacheResultsInMemory=False,
    CacheSolveResults=False,
    RemoteDefinitionLocation="http://127.0.0.1:5000/seek_file",
    RemoteSolveVersion=(0, 1, 0),
    ShowInput_Enabled=False,
    ShowInput_Path=False,
    SynchronousSolve=True)
tell_file = Hops(
    File_name="C:\Users\Sculpture\Desktop\my_file_Desktop.txt",
    CacheResultsInMemory=False,
    CacheSolveResults=False,
    RemoteDefinitionLocation="http://127.0.0.1:5000/tell_file",
    RemoteSolveVersion=(0, 1, 0),
    ShowInput_Enabled=False,
    ShowInput_Path=False,
    SynchronousSolve=True)
readline_file = Hops(
    File_name="C:\Users\Sculpture\Desktop\my_file_Desktop.txt",
    CacheResultsInMemory=True,
    CacheSolveResults=True,
    RemoteDefinitionLocation="http://127.0.0.1:5000/readline_file",
    RemoteSolveVersion=(0, 1, 0),
    ShowInput_Enabled=False,
    ShowInput_Path=False,
    SynchronousSolve=True)
append_file_append = Hops(
    File_name="vendor_test.txt",
    File_content="Michael David Wickerson",
    CacheResultsInMemory=False,
    CacheSolveResults=False,
    RemoteDefinitionLocation="http://127.0.0.1:5000/append_file_append",
    RemoteSolveVersion=(0, 1, 0),
    ShowInput_Enabled=False,
    ShowInput_Path=False,
    SynchronousSolve=True)
open_file_append = Hops(
    File_name="my_file.txt",
    File_content="the rain in Spain",
    CacheResultsInMemory=False,
    CacheSolveResults=False,
    RemoteDefinitionLocation="http://127.0.0.1:5000/open_file_append",
    RemoteSolveVersion=(0, 1, 0),
    ShowInput_Enabled=False,
    ShowInput_Path=False,
    SynchronousSolve=True)
create_file = Hops(
    File_name="write_test",
    File_content="Michael",
    CacheResultsInMemory=False,
    CacheSolveResults=False,
    RemoteDefinitionLocation="http://127.0.0.1:5000/create_file",
    RemoteSolveVersion=(0, 1, 0),
    ShowInput_Enabled=False,
    ShowInput_Path=False,
    SynchronousSolve=True)
split_file = Hops(
    File_name="vendor_test.txt",
    File_content="Michael David Wickerson",
    CacheResultsInMemory=False,
    CacheSolveResults=False,
    RemoteDefinitionLocation="http://127.0.0.1:5000/split_file",
    RemoteSolveVersion=(0, 1, 0),
    ShowInput_Enabled=False,
    ShowInput_Path=False,
    SynchronousSolve=True)
open_file = Hops(
    File_name="my_file.txt",
    CacheResultsInMemory=False,
    CacheSolveResults=False,
    RemoteDefinitionLocation="http://127.0.0.1:5000/open_file",
    RemoteSolveVersion=(0, 1, 0),
    ShowInput_Enabled=False,
    ShowInput_Path=False,
    SynchronousSolve=True)
open_file_desktop = Hops(
    File_name="C:\Users\Sculpture\Desktop\my_file_Desktop.txt",
    CacheResultsInMemory=True,
    CacheSolveResults=True,
    RemoteDefinitionLocation="http://127.0.0.1:5000/open_file_desktop",
    RemoteSolveVersion=(0, 1, 0),
    ShowInput_Enabled=False,
    ShowInput_Path=False,
    SynchronousSolve=True)
panel_8 = Panel(open_file_append)
panel_9 = Panel(split_file)
panel_10 = Panel(open_file)
panel_11 = Panel(open_file_desktop)
panel_12 = Panel(seek_file)
panel_13 = Panel(tell_file)
panel_14 = Panel(readline_file)
panel_15 = Panel(create_file)
panel_16 = Panel(append_file_append)
