# Grasshopper definition PFHG_010.gh (Grasshopper 1.0.7)
# plug-ins: Hops

# FLASK | HOPS | PYTHON 3 | GRASSHOPPER
# PFHG_010.gh
# Examples Wickerson Studios
# REGULAR EXPRESSIONS
# /_findall
# /_match1
# /_match_start
panel = Panel()
panel_2 = Panel()
panel_3 = Panel("click")
panel_4 = Panel()
panel_5 = Panel("Double")
start_end2 = Hops(
    String=panel_4,
    Pattern="click",
    CacheResultsInMemory=True,
    CacheSolveResults=True,
    RemoteDefinitionLocation="http://127.0.0.1:5000/start_end2",
    RemoteSolveVersion=(0, 1, 0),
    ShowInput_Enabled=False,
    ShowInput_Path=False,
    SynchronousSolve=True)  # -> Start, End
findall = Hops(
    String=panel,
    Pattern="panel ",
    CacheResultsInMemory=True,
    CacheSolveResults=True,
    RemoteDefinitionLocation="http://127.0.0.1:5000/_findall",
    RemoteSolveVersion=(0, 1, 0),
    ShowInput_Enabled=False,
    ShowInput_Path=False,
    SynchronousSolve=True)
match1 = Hops(
    String=panel_2,
    Pattern="disco-ball",
    CacheResultsInMemory=True,
    CacheSolveResults=True,
    RemoteDefinitionLocation="http://127.0.0.1:5000/_match1",
    RemoteSolveVersion=(0, 1, 0),
    ShowInput_Enabled=False,
    ShowInput_Path=False,
    SynchronousSolve=True)
panel_6 = Panel([start_end2.Start, start_end2.End])
panel_7 = Panel(findall)
panel_8 = Panel(match1)
