# Grasshopper definition PFHG_011.gh (Grasshopper 1.0.7)
# plug-ins: Hops

# FLASK | HOPS | PYTHON 3 | GRASSHOPPER
# PFHG_011.gh
# Examples Wickerson Studios
# COLLECTIONS MODULE
# /_create_counter
panel = Panel()
ordered_dict = Hops(
    CacheResultsInMemory=True,
    CacheSolveResults=True,
    RemoteDefinitionLocation="http://127.0.0.1:5000/ordered_dict",
    RemoteSolveVersion=(0, 1, 0),
    ShowInput_Enabled=False,
    ShowInput_Path=False,
    SynchronousSolve=True)
create_counter = Hops(
    String=panel,
    CacheResultsInMemory=False,
    CacheSolveResults=False,
    RemoteDefinitionLocation="http://127.0.0.1:5000/_create_counter",
    RemoteSolveVersion=(0, 1, 0),
    ShowInput_Enabled=False,
    ShowInput_Path=False,
    SynchronousSolve=True)
panel_2 = Panel(ordered_dict)
panel_3 = Panel(create_counter)
