# Grasshopper definition PFHG_012test.gh (Grasshopper 1.0.7)
# plug-ins: Hops

# FLASK | HOPS | PYTHON 3 | GRASSHOPPER
# PFHG_012.gh
# Examples Wickerson Studios
# PYTHON ADVANCE
# OS Module with Examples
number_slider = Slider(0, range=0..1)
listdir = Hops(
    String=Slider(1, range=0..1),
    CacheResultsInMemory=False,
    CacheSolveResults=False,
    RemoteDefinitionLocation="http://127.0.0.1:5000/listdir",
    RemoteSolveVersion=(0, 1, 0),
    ShowInput_Enabled=False,
    ShowInput_Path=False,
    SynchronousSolve=True)
mkdir_advanced = Hops(
    Directory="desktop",
    Parent_directory="C:/",
    CacheResultsInMemory=False,
    CacheSolveResults=False,
    RemoteDefinitionLocation="http://127.0.0.1:5000/mkdir_advanced",
    RemoteSolveVersion=(0, 1, 0),
    ShowInput_Enabled=False,
    ShowInput_Path=False,
    SynchronousSolve=True)
os_chdir = Hops(
    String=Slider(0, range=0..1),
    CacheResultsInMemory=True,
    CacheSolveResults=True,
    RemoteDefinitionLocation="http://127.0.0.1:5000/_os_chdir",
    RemoteSolveVersion=(0, 1, 0),
    ShowInput_Enabled=False,
    ShowInput_Path=False,
    SynchronousSolve=True)
os_getcwd = Hops(
    String=Slider(0, range=0..1),
    CacheResultsInMemory=True,
    CacheSolveResults=True,
    RemoteDefinitionLocation="http://127.0.0.1:5000/_os_getcwd",
    RemoteSolveVersion=(0, 1, 0),
    ShowInput_Enabled=False,
    ShowInput_Path=False,
    SynchronousSolve=True)
os_system = Hops(
    String=Slider(0, range=0..1),
    CacheResultsInMemory=True,
    CacheSolveResults=True,
    RemoteDefinitionLocation="http://127.0.0.1:5000/_os_system",
    RemoteSolveVersion=(0, 1, 0),
    ShowInput_Enabled=False,
    ShowInput_Path=False,
    SynchronousSolve=True)
op = Hops(
    String=number_slider,
    CacheResultsInMemory=False,
    CacheSolveResults=False,
    RemoteDefinitionLocation="http://127.0.0.1:5000/_os",
    RemoteSolveVersion=(0, 1, 0),
    ShowInput_Enabled=False,
    ShowInput_Path=False,
    SynchronousSolve=True)
os_path = Hops(
    String=Slider(0, range=0..1),
    CacheResultsInMemory=True,
    CacheSolveResults=True,
    RemoteDefinitionLocation="http://127.0.0.1:5000/_os_path",
    RemoteSolveVersion=(0, 1, 0),
    ShowInput_Enabled=False,
    ShowInput_Path=False,
    SynchronousSolve=True)
panel = Panel(os_system)
panel_2 = Panel(op)
panel_3 = Panel(os_path)
panel_4 = Panel(os_getcwd)
panel_5 = Panel(os_chdir)
panel_6 = Panel(mkdir_advanced)
panel_7 = Panel(listdir)
