# Grasshopper definition PFHG_013.gh (Grasshopper 1.0.7)
# plug-ins: Hops

# ----
# FLASK | HOPS | PYTHON 3 | GRASSHOPPER
# PFHG_013.gh
# Examples Wickerson Studios
# ALGORITHMS
# /bubble
# /selection
# /insertion
# /shell
range = Range(Domain=Domain(0, 1), Steps=10)
jitter = Jitter(List=range, Jitter=1, Seed=2)  # -> Values, Indices
panel = Panel(jitter.Values)
bubble = Hops(
    NumberList=panel,
    CacheResultsInMemory=True,
    CacheSolveResults=True,
    RemoteDefinitionLocation="http://127.0.0.1:5000/bubble",
    RemoteSolveVersion=(0, 1, 0),
    ShowInput_Enabled=False,
    ShowInput_Path=False,
    SynchronousSolve=True)
insertion = Hops(
    NumberList=panel,
    CacheResultsInMemory=True,
    CacheSolveResults=True,
    RemoteDefinitionLocation="http://127.0.0.1:5000/insertion",
    RemoteSolveVersion=(0, 1, 0),
    ShowInput_Enabled=False,
    ShowInput_Path=False,
    SynchronousSolve=True)
shell = Hops(
    NumberList=panel,
    CacheResultsInMemory=True,
    CacheSolveResults=True,
    RemoteDefinitionLocation="http://127.0.0.1:5000/shell",
    RemoteSolveVersion=(0, 1, 0),
    ShowInput_Enabled=False,
    ShowInput_Path=False,
    SynchronousSolve=True)
selection = Hops(
    NumberList=panel,
    CacheResultsInMemory=True,
    CacheSolveResults=True,
    RemoteDefinitionLocation="http://127.0.0.1:5000/selection",
    RemoteSolveVersion=(0, 1, 0),
    ShowInput_Enabled=False,
    ShowInput_Path=False,
    SynchronousSolve=True)
panel_2 = Panel(bubble)
panel_3 = Panel(insertion)
panel_4 = Panel(shell)
panel_5 = Panel(selection)

# ----
# /anagram1
# /palindrome1
# /_prime100
# /_fibonacci
number_slider = Slider(21, range=0..100)
fibonacci = Hops(
    Number=number_slider,
    CacheResultsInMemory=True,
    CacheSolveResults=True,
    RemoteDefinitionLocation="http://127.0.0.1:5000/_fibonacci",
    RemoteSolveVersion=(0, 1, 0),
    ShowInput_Enabled=False,
    ShowInput_Path=False,
    SynchronousSolve=True)
prime100 = Hops(
    Number=Slider(25, range=0..100),
    CacheResultsInMemory=True,
    CacheSolveResults=True,
    RemoteDefinitionLocation="http://127.0.0.1:5000/_prime100",
    RemoteSolveVersion=(0, 1, 0),
    ShowInput_Enabled=False,
    ShowInput_Path=False,
    SynchronousSolve=True)
anagram1 = Hops(
    String="Michael",
    CacheResultsInMemory=False,
    CacheSolveResults=False,
    RemoteDefinitionLocation="http://127.0.0.1:5000/anagram1",
    RemoteSolveVersion=(0, 1, 0),
    ShowInput_Enabled=False,
    ShowInput_Path=False,
    SynchronousSolve=True)
palindrome1 = Hops(
    String="boob",
    CacheResultsInMemory=True,
    CacheSolveResults=True,
    RemoteDefinitionLocation="http://127.0.0.1:5000/palindrome1",
    RemoteSolveVersion=(0, 1, 0),
    ShowInput_Enabled=False,
    ShowInput_Path=False,
    SynchronousSolve=True)
panel_6 = Panel(anagram1)
panel_7 = Panel(palindrome1)
panel_8 = Panel(prime100)
panel_9 = Panel(fibonacci)
