# Grasshopper definition PFHG_014.gh (Grasshopper 1.0.7)
# plug-ins: Hops

series = Series(Start=Slider(4, range=0..10), Step=Slider(0, range=0..100), Count=Slider(3, range=0..10))
panel = Panel(series)
randarr5 = Hops(
    Amount=Slider(35, range=0..100),
    Number=panel,
    CacheResultsInMemory=True,
    CacheSolveResults=True,
    RemoteDefinitionLocation="http://127.0.0.1:5000/randarr5",
    RemoteSolveVersion=(0, 1, 0),
    ShowInput_Enabled=False,
    ShowInput_Path=False,
    SynchronousSolve=True)
panel_2 = Panel(randarr5)

number_slider = Slider(3, range=0..10)
series_2 = Series(Start=Slider(3, range=0..10), Step=Slider(7, range=0..100), Count=number_slider)
series_3 = Series(Start=Slider(4, range=0..10), Step=Slider(67, range=0..100), Count=number_slider)
panel_3 = Panel(series_2)
panel_4 = Panel(series_3)
array_stats7 = Hops(
    AList=panel_3,
    AList2=panel_4,
    CacheResultsInMemory=True,
    CacheSolveResults=True,
    RemoteDefinitionLocation="http://127.0.0.1:5000/array_stats7",
    RemoteSolveVersion=(0, 1, 0),
    ShowInput_Enabled=False,
    ShowInput_Path=False,
    SynchronousSolve=True)  # -> Dim, Shape, Size
panel_5 = Panel(array_stats7.Shape)
panel_6 = Panel(array_stats7.Dim)
panel_7 = Panel(array_stats7.Size)

number_slider_2 = Slider(3, range=0..10)
number_slider_3 = Slider(4, range=0..10)
# FLASK | HOPS | PYTHON 3 | GRASSHOPPER
# PFHG_014.gh
# Examples Wickerson Studios
# NUMPY
panel_8 = Panel("5")
series_4 = Series(Start=0, Step=1, Count=Slider(4, range=0..10))
series_5 = Series(Start=0, Step=1, Count=panel_8)
series_6 = Series(Start=Slider(2, range=0..10), Step=Slider(32, range=0..100), Count=number_slider_2)
series_7 = Series(Start=Slider(2, range=0..10), Step=Slider(26, range=0..100), Count=number_slider_2)
series_8 = Series(Start=Slider(5, range=0..10), Step=Slider(19, range=0..100), Count=number_slider_2)
series_9 = Series(Start=Slider(3, range=0..10), Step=Slider(7, range=0..100), Count=number_slider_2)
series_10 = Series(Start=Slider(2, range=0..10), Step=Slider(32, range=0..100), Count=number_slider_2)
series_11 = Series(Start=Slider(3, range=0..10), Step=Slider(22, range=0..100), Count=number_slider_2)
series_12 = Series(Start=Slider(2, range=0..10), Step=Slider(11, range=0..100), Count=Slider(4, range=0..10))
series_13 = Series(Start=Slider(3, range=0..10), Step=Slider(7, range=0..100), Count=Slider(3, range=0..10))
series_14 = Series(Start=Slider(2, range=0..10), Step=Slider(32, range=0..100), Count=Slider(3, range=0..10))
panel_9 = Panel(series_4)
panel_10 = Panel(series_5)
panel_11 = Panel(series_6)
panel_12 = Panel(series_7)
panel_13 = Panel(series_9)
panel_14 = Panel(series_8)
panel_15 = Panel(series_10)
panel_16 = Panel(series_11)
panel_17 = Panel(series_12)
panel_18 = Panel(series_13)
panel_19 = Panel(series_14)
randarr = Hops(
    Number=panel_10,
    CacheResultsInMemory=True,
    CacheSolveResults=True,
    RemoteDefinitionLocation="http://127.0.0.1:5000/randarr",
    RemoteSolveVersion=(0, 1, 0),
    ShowInput_Enabled=False,
    ShowInput_Path=False,
    SynchronousSolve=True)
randarr_2 = Hops(
    Number=panel_9,
    CacheResultsInMemory=True,
    CacheSolveResults=True,
    RemoteDefinitionLocation="http://127.0.0.1:5000/randarr",
    RemoteSolveVersion=(0, 1, 0),
    ShowInput_Enabled=False,
    ShowInput_Path=False,
    SynchronousSolve=True)
array_list44 = Hops(
    AList=panel_13,
    BList=panel_15,
    CacheResultsInMemory=True,
    CacheSolveResults=True,
    RemoteDefinitionLocation="http://127.0.0.1:5000/array_list44",
    RemoteSolveVersion=(0, 1, 0),
    ShowInput_Enabled=False,
    ShowInput_Path=False,
    SynchronousSolve=True)
array_list = Hops(
    AList=panel_16,
    CacheResultsInMemory=True,
    CacheSolveResults=True,
    RemoteDefinitionLocation="http://127.0.0.1:5000/array_list",
    RemoteSolveVersion=(0, 1, 0),
    ShowInput_Enabled=False,
    ShowInput_Path=False,
    SynchronousSolve=True)
array_3lists = Hops(
    AList=panel_11,
    BList=panel_12,
    CList=panel_14,
    CacheResultsInMemory=True,
    CacheSolveResults=True,
    RemoteDefinitionLocation="http://127.0.0.1:5000/array_3lists",
    RemoteSolveVersion=(0, 1, 0),
    ShowInput_Enabled=False,
    ShowInput_Path=False,
    SynchronousSolve=True)
array_stats4 = Hops(
    AList=panel_18,
    AList3=panel_19,
    CacheResultsInMemory=True,
    CacheSolveResults=True,
    RemoteDefinitionLocation="http://127.0.0.1:5000/array_stats4",
    RemoteSolveVersion=(0, 1, 0),
    ShowInput_Enabled=False,
    ShowInput_Path=False,
    SynchronousSolve=True)  # -> Mean, Std, Min, Max, Median
array_stats = Hops(
    AList=panel_17,
    CacheResultsInMemory=True,
    CacheSolveResults=True,
    RemoteDefinitionLocation="http://127.0.0.1:5000/array_stats",
    RemoteSolveVersion=(0, 1, 0),
    ShowInput_Enabled=False,
    ShowInput_Path=False,
    SynchronousSolve=True)  # -> Mean, Std
panel_20 = Panel(array_list44)
panel_21 = Panel(array_3lists)
# NUMPY
# ARRAY CREATION
# CONTINUED
panel_22 = Panel(randarr)
panel_23 = Panel(randarr_2)
panel_24 = Panel(array_list)
panel_25 = Panel(array_stats.Std)
panel_26 = Panel(array_stats.Mean)
panel_27 = Panel([array_stats4.Mean, array_stats4.Std, array_stats4.Min, array_stats4.Max, array_stats4.Median])
number_slider_4 = Slider(5, range=0..10)
panel_28 = Panel("4")
series_15 = Series(Start=Slider(3, range=0..10), Step=1, Count=number_slider_4)
series_16 = Series(Start=0, Step=1, Count=number_slider_4)
series_17 = Series(Start=0, Step=1, Count=number_slider_4)
panel_29 = Panel(series_15)
array_full = Hops(
    AList=series_16,
    BList=panel_29,
    CacheResultsInMemory=True,
    CacheSolveResults=True,
    RemoteDefinitionLocation="http://127.0.0.1:5000/array_full",
    RemoteSolveVersion=(0, 1, 0),
    ShowInput_Enabled=False,
    ShowInput_Path=False,
    SynchronousSolve=True)
array_ones = Hops(
    AList=series_17,
    CacheResultsInMemory=True,
    CacheSolveResults=True,
    RemoteDefinitionLocation="http://127.0.0.1:5000/array_ones",
    RemoteSolveVersion=(0, 1, 0),
    ShowInput_Enabled=False,
    ShowInput_Path=False,
    SynchronousSolve=True)
array_zeros = Hops(
    AList=series_16,
    CacheResultsInMemory=True,
    CacheSolveResults=True,
    RemoteDefinitionLocation="http://127.0.0.1:5000/array_zeros",
    RemoteSolveVersion=(0, 1, 0),
    ShowInput_Enabled=False,
    ShowInput_Path=False,
    SynchronousSolve=True)
panel_30 = Panel(array_zeros)
panel_31 = Panel(array_full)
panel_32 = Panel(array_ones)
# OPERATIONS:
number_slider_5 = Slider(3, range=0..10)
number_slider_6 = Slider(4, range=0..10)
series_18 = Series(Start=0, Step=1, Count=10)
series_19 = Series(Start=number_slider_5, Step=1, Count=10)

number_slider_7 = Slider(4, range=0..10)
series_20 = Series(Start=Slider(0, range=0..10), Step=Slider(2, range=0..21), Count=number_slider_7)
randarr55 = Hops(
    Amount=Slider(43, range=0..100),
    Number=series_20,
    CacheResultsInMemory=True,
    CacheSolveResults=True,
    RemoteDefinitionLocation="http://127.0.0.1:5000/randarr55",
    RemoteSolveVersion=(0, 1, 0),
    ShowInput_Enabled=False,
    ShowInput_Path=False,
    SynchronousSolve=True)
panel_33 = Panel(randarr55)

series_21 = Series(Start=0, Step=1, Count=number_slider_6)
series_22 = Series(Start=0, Step=1, Count=number_slider_6)
series_23 = Series(Start=0, Step=1, Count=number_slider_6)
array_operations = Hops(
    AList=series_18,
    BList=series_19,
    CacheResultsInMemory=True,
    CacheSolveResults=True,
    RemoteDefinitionLocation="http://127.0.0.1:5000/array_operations",
    RemoteSolveVersion=(0, 1, 0),
    ShowInput_Enabled=False,
    ShowInput_Path=False,
    SynchronousSolve=True)  # -> Array_add, Array_sub, Array_mul, Array_div
entwine = Entwine(Branch00=series_21, Branch01=series_23, Branch02=series_22, FlattenInputs=True)
series_24 = Series(Start=Slider(3, range=0..10), Step=Slider(0, range=0..1), Count=number_slider_7)
panel_34 = Panel(array_operations.Array_add)
panel_35 = Panel(entwine)
panel_36 = Panel(array_operations.Array_sub)
panel_37 = Panel(series_24)
panel_38 = Panel(series_20)
panel_39 = Panel(array_operations.Array_mul)
array_tanspose = Hops(
    AList=panel_35,
    CacheResultsInMemory=True,
    CacheSolveResults=True,
    RemoteDefinitionLocation="http://127.0.0.1:5000/array_transpose",
    RemoteSolveVersion=(0, 1, 0),
    ShowInput_Enabled=False,
    ShowInput_Path=False,
    SynchronousSolve=True)
array_reshape = Hops(
    AList=panel_35,
    CacheResultsInMemory=True,
    CacheSolveResults=True,
    RemoteDefinitionLocation="http://127.0.0.1:5000/array_reshape",
    RemoteSolveVersion=(0, 1, 0),
    ShowInput_Enabled=False,
    ShowInput_Path=False,
    SynchronousSolve=True)
panel_40 = Panel(array_operations.Array_div)
array_conditional = Hops(
    AList=panel_38,
    BList=panel_37,
    CacheResultsInMemory=True,
    CacheSolveResults=True,
    RemoteDefinitionLocation="http://127.0.0.1:5000/array_conditional",
    RemoteSolveVersion=(0, 1, 0),
    ShowInput_Enabled=False,
    ShowInput_Path=False,
    SynchronousSolve=True)
panel_41 = Panel(array_reshape)
panel_42 = Panel(array_tanspose)
panel_43 = Panel(array_conditional)
# LINEAR REGRESSION
# AND
# MATPLOTLIB
number_slider_8 = Slider(48, range=0..100)
series_25 = Series(Start=0, Step=1, Count=number_slider_8)
series_26 = Series(Start=Slider(122, range=0..1000), Step=1, Count=number_slider_8)
jitter = Jitter(List=series_26, Jitter=Slider(0.68, range=0..1), Seed=Slider(20, range=0..100))  # -> Values, Indices
jitter_2 = Jitter(List=series_25, Jitter=1, Seed=2)  # -> Values, Indices
linear_regression_plot = Hops(
    XList=jitter_2.Values,
    YList=jitter.Values,
    CacheResultsInMemory=True,
    CacheSolveResults=True,
    RemoteDefinitionLocation="http://127.0.0.1:5000/linear_regression_plot",
    RemoteSolveVersion=(0, 1, 0),
    ShowInput_Enabled=False,
    ShowInput_Path=False,
    SynchronousSolve=True)
linear_regression = Hops(
    XList=jitter_2.Values,
    YList=jitter.Values,
    CacheResultsInMemory=True,
    CacheSolveResults=True,
    RemoteDefinitionLocation="http://127.0.0.1:5000/linear_regression",
    RemoteSolveVersion=(0, 1, 0),
    ShowInput_Enabled=False,
    ShowInput_Path=False,
    SynchronousSolve=True)
panel_44 = Panel(linear_regression)
panel_45 = Panel(linear_regression_plot)
