# Grasshopper definition PFHG_014b.gh (Grasshopper 1.0.7)
# plug-ins: Hops

# /_3list_array
# /_3lists_Transpose
number_slider = Slider(10, range=0..10)
number_slider_2 = Slider(2, range=0..10)
# /_2lists9
# /_2lists_Transpose
number_slider_3 = Slider(3, range=0..10)
number_slider_4 = Slider(3, range=0..10)
series = Series(Start=0, Step=1, Count=10)
number_slider_5 = Slider(3, range=0..10)
# FLASK | HOPS | PYTHON 3 | GRASSHOPPER
# PFHG_014b.gh
# Examples Wickerson Studios
# NUMPY
# continued...
# /array_from_listsWS
# /array_from_listsWSb
array_from_listws = Hops(
    AList=series,
    CacheResultsInMemory=True,
    CacheSolveResults=True,
    RemoteDefinitionLocation="http://127.0.0.1:5000/array_from_listWS",
    RemoteSolveVersion=(0, 1, 0),
    ShowInput_Enabled=False,
    ShowInput_Path=False,
    SynchronousSolve=True)
array_from_listwsb = Hops(
    AList=series,
    CacheResultsInMemory=True,
    CacheSolveResults=True,
    RemoteDefinitionLocation="http://127.0.0.1:5000/array_from_listWSb",
    RemoteSolveVersion=(0, 1, 0),
    ShowInput_Enabled=False,
    ShowInput_Path=False,
    SynchronousSolve=True)
series_2 = Series(Start=0, Step=1, Count=number_slider_2)
series_3 = Series(Start=number_slider, Step=1, Count=number_slider_2)
series_4 = Series(Start=0, Step=1, Count=number_slider_3)
series_5 = Series(Start=Slider(10, range=0..10), Step=1, Count=number_slider_3)
series_6 = Series(Start=0, Step=1, Count=number_slider_4)
series_7 = Series(Start=Slider(5, range=0..10), Step=1, Count=number_slider_4)
series_8 = Series(Start=Slider(10, range=0..10), Step=1, Count=number_slider_4)
series_9 = Series(Start=0, Step=1, Count=number_slider_5)
series_10 = Series(Start=Slider(5, range=0..10), Step=1, Count=number_slider_5)
series_11 = Series(Start=Slider(10, range=0..10), Step=1, Count=number_slider_5)
panel = Panel(array_from_listws)
panel_2 = Panel(array_from_listwsb)
panel_3 = Panel(series_2)
panel_4 = Panel(series_3)
panel_5 = Panel(series_4)
panel_6 = Panel(series_5)
panel_7 = Panel(series_6)
panel_8 = Panel(series_7)
panel_9 = Panel(series_8)
panel_10 = Panel(series_9)
panel_11 = Panel(series_10)
panel_12 = Panel(series_11)
_2lists9 = Hops(
    AList=panel_5,
    BList=panel_6,
    CacheResultsInMemory=True,
    CacheSolveResults=True,
    RemoteDefinitionLocation="http://127.0.0.1:5000/_2lists9",
    RemoteSolveVersion=(0, 1, 0),
    ShowInput_Enabled=False,
    ShowInput_Path=False,
    SynchronousSolve=True)  # -> L0, L1
_2lists_transpose = Hops(
    AList=panel_3,
    BList=panel_4,
    CacheResultsInMemory=False,
    CacheSolveResults=False,
    RemoteDefinitionLocation="http://127.0.0.1:5000/_2lists_Transpose",
    RemoteSolveVersion=(0, 1, 0),
    ShowInput_Enabled=False,
    ShowInput_Path=False,
    SynchronousSolve=True)  # -> L0, L1
_3list_array = Hops(
    AList=panel_7,
    BList=panel_8,
    CList=panel_9,
    CacheResultsInMemory=True,
    CacheSolveResults=True,
    RemoteDefinitionLocation="http://127.0.0.1:5000/_3list_array",
    RemoteSolveVersion=(0, 1, 0),
    ShowInput_Enabled=False,
    ShowInput_Path=False,
    SynchronousSolve=True)  # -> L0, L1, L2
_3list_transpose = Hops(
    AList=panel_10,
    BList=panel_11,
    CList=panel_12,
    CacheResultsInMemory=True,
    CacheSolveResults=True,
    RemoteDefinitionLocation="http://127.0.0.1:5000/_3list_transpose",
    RemoteSolveVersion=(0, 1, 0),
    ShowInput_Enabled=False,
    ShowInput_Path=False,
    SynchronousSolve=True)  # -> L0, L1, L2
panel_13 = Panel(_2lists_transpose.L1)
panel_14 = Panel(_2lists_transpose.L0)
panel_15 = Panel(_2lists9.L1)
panel_16 = Panel(_2lists9.L0)
panel_17 = Panel(_3list_array.L0)
panel_18 = Panel(_3list_array.L1)
panel_19 = Panel(_3list_array.L2)
panel_20 = Panel(_3list_transpose.L0)
panel_21 = Panel(_3list_transpose.L2)
panel_22 = Panel(_3list_transpose.L1)
entwine = Entwine(Branch00=panel_14, Branch01=panel_13, FlattenInputs=True)
entwine_2 = Entwine(Branch00=panel_16, Branch01=panel_15, FlattenInputs=True)
entwine_3 = Entwine(Branch00=panel_17, Branch01=panel_18, Branch02=panel_19, FlattenInputs=True)
entwine_4 = Entwine(Branch00=panel_20, Branch01=panel_22, Branch02=panel_21, FlattenInputs=True)
panel_23 = Panel(entwine)
panel_24 = Panel(entwine_2)
panel_25 = Panel(entwine_3)
panel_26 = Panel(entwine_4)

# ----
# /_reshape3
number_slider_6 = Slider(5, range=0..10)
number_slider_7 = Slider(4, range=0..10)
series_12 = Series(Start=0, Step=1, Count=number_slider_7)
series_13 = Series(Start=number_slider_6, Step=1, Count=number_slider_7)
series_14 = Series(Start=Slider(10, range=0..10), Step=1, Count=number_slider_7)
panel_27 = Panel(series_12)
panel_28 = Panel(series_13)
panel_29 = Panel(series_14)
reshape3 = Hops(
    AList=panel_27,
    BList=panel_28,
    CList=panel_29,
    CacheResultsInMemory=True,
    CacheSolveResults=True,
    RemoteDefinitionLocation="http://127.0.0.1:5000/_reshape3",
    RemoteSolveVersion=(0, 1, 0),
    ShowInput_Enabled=False,
    ShowInput_Path=False,
    SynchronousSolve=True)  # -> L0, L1, L2, L3
panel_30 = Panel(reshape3.L0)
panel_31 = Panel(reshape3.L1)
panel_32 = Panel(reshape3.L2)
panel_33 = Panel(reshape3.L3)
entwine_5 = Entwine(Branch00=panel_30, Branch01=panel_31, Branch02=panel_32, Branch03=panel_33, FlattenInputs=True)
panel_34 = Panel(entwine_5)

# ----
# /_flatten
number_slider_8 = Slider(4, range=0..10)
series_15 = Series(Start=0, Step=1, Count=number_slider_8)
series_16 = Series(Start=Slider(5, range=0..10), Step=1, Count=number_slider_8)
series_17 = Series(Start=Slider(10, range=0..10), Step=1, Count=number_slider_8)
panel_35 = Panel(series_15)
panel_36 = Panel(series_16)
panel_37 = Panel(series_17)
flatten2 = Hops(
    AList=panel_35,
    BList=panel_36,
    CList=panel_37,
    CacheResultsInMemory=True,
    CacheSolveResults=True,
    RemoteDefinitionLocation="http://127.0.0.1:5000/_flatten2",
    RemoteSolveVersion=(0, 1, 0),
    ShowInput_Enabled=False,
    ShowInput_Path=False,
    SynchronousSolve=True)
panel_38 = Panel(flatten2)
# /_indexing2
number_slider_9 = Slider(4, range=0..10)
series_18 = Series(Start=0, Step=1, Count=number_slider_9)
series_19 = Series(Start=Slider(3, range=0..10), Step=1, Count=number_slider_9)
series_20 = Series(Start=Slider(7, range=0..10), Step=1, Count=number_slider_9)
series_21 = Series(Start=Slider(10, range=0..10), Step=1, Count=number_slider_9)
panel_39 = Panel(series_18)
panel_40 = Panel(series_19)
panel_41 = Panel(series_20)
panel_42 = Panel(series_21)
indexing2 = Hops(
    AList=panel_39,
    BList=panel_40,
    CList=panel_41,
    DList=panel_42,
    CacheResultsInMemory=True,
    CacheSolveResults=True,
    RemoteDefinitionLocation="http://127.0.0.1:5000/_indexing2",
    RemoteSolveVersion=(0, 1, 0),
    ShowInput_Enabled=False,
    ShowInput_Path=False,
    SynchronousSolve=True)  # -> L0, L1, L2, L3
panel_43 = Panel(indexing2.L0)
panel_44 = Panel(indexing2.L1)
panel_45 = Panel(indexing2.L3)
panel_46 = Panel(indexing2.L2)
entwine_6 = Entwine(Branch00=panel_43, Branch01=panel_44, Branch02=panel_46, Branch03=panel_45, FlattenInputs=True)
panel_47 = Panel(entwine_6)
# /_all3
number_slider_10 = Slider(4, range=0..10)
series_22 = Series(Start=0, Step=1, Count=number_slider_10)
series_23 = Series(Start=Slider(3, range=0..10), Step=1, Count=number_slider_10)
series_24 = Series(Start=Slider(7, range=0..10), Step=1, Count=number_slider_10)
series_25 = Series(Start=Slider(10, range=0..10), Step=1, Count=number_slider_10)
panel_48 = Panel(series_22)
panel_49 = Panel(series_23)
panel_50 = Panel(series_24)
panel_51 = Panel(series_25)
all3 = Hops(
    A=panel_48,
    B=panel_49,
    C=panel_50,
    D=panel_51,
    CacheResultsInMemory=True,
    CacheSolveResults=True,
    RemoteDefinitionLocation="http://127.0.0.1:5000/_all3",
    RemoteSolveVersion=(0, 1, 0),
    ShowInput_Enabled=False,
    ShowInput_Path=False,
    SynchronousSolve=True)
panel_52 = Panel(all3)
# /_any
number_slider_11 = Slider(4, range=0..10)
series_26 = Series(Start=0, Step=1, Count=number_slider_11)
series_27 = Series(Start=Slider(3, range=0..10), Step=1, Count=number_slider_11)
series_28 = Series(Start=Slider(7, range=0..10), Step=1, Count=number_slider_11)
series_29 = Series(Start=Slider(10, range=0..10), Step=1, Count=number_slider_11)
panel_53 = Panel(series_26)
panel_54 = Panel(series_27)
panel_55 = Panel(series_28)
panel_56 = Panel(series_29)
any = Hops(
    A=panel_53,
    B=panel_54,
    C=panel_55,
    D=panel_56,
    CacheResultsInMemory=True,
    CacheSolveResults=True,
    RemoteDefinitionLocation="http://127.0.0.1:5000/_any",
    RemoteSolveVersion=(0, 1, 0),
    ShowInput_Enabled=False,
    ShowInput_Path=False,
    SynchronousSolve=True)
panel_57 = Panel(any)
