# Grasshopper definition PFHG_015.gh (Grasshopper 1.0.7)
# plug-ins: Hops

# ----
# LINEAR REGRESSION
# AND
# MATPLOTLIB
# /linear_regression_plot
# /plot_scatter
# /plot_graph
# /plot_bar
# /plot_pie
# /plot_donut
# /plot_scatter_3d
number_slider = Slider(20, range=0..100)
number_slider_2 = Slider(22, range=0..100)
series = Series(Start=Slider(122, range=0..1000), Step=1, Count=number_slider)
series_2 = Series(Start=0, Step=1, Count=number_slider)
jitter = Jitter(List=series_2, Jitter=1, Seed=2)  # -> Values, Indices
jitter_2 = Jitter(List=series, Jitter=Slider(0.68, range=0..1), Seed=Slider(15, range=0..100))  # -> Values, Indices
jitter_3 = Jitter(List=series, Jitter=Slider(0.54, range=0..1), Seed=Slider(15, range=0..100))  # -> Values, Indices
linear_regression_plot = Hops(
    XList=jitter.Values,
    YList=jitter_2.Values,
    CacheResultsInMemory=True,
    CacheSolveResults=True,
    RemoteDefinitionLocation="http://127.0.0.1:5000/linear_regression_plot",
    RemoteSolveVersion=(0, 1, 0),
    ShowInput_Enabled=False,
    ShowInput_Path=False,
    SynchronousSolve=True)  # disabled
# FLASK | HOPS | PYTHON 3 | GRASSHOPPER
# PFHG_014.gh
linear_regression = Hops(
    XList=jitter.Values,
    YList=jitter_2.Values,
    CacheResultsInMemory=True,
    CacheSolveResults=True,
    RemoteDefinitionLocation="http://127.0.0.1:5000/linear_regression",
    RemoteSolveVersion=(0, 1, 0),
    ShowInput_Enabled=False,
    ShowInput_Path=False,
    SynchronousSolve=True)
plot_scatter_3d = Hops(
    XList=jitter.Values,
    YList=jitter_2.Values,
    ZList=jitter_3.Values,
    CacheResultsInMemory=True,
    CacheSolveResults=True,
    RemoteDefinitionLocation="http://127.0.0.1:5000/plot_scatter_3d",
    RemoteSolveVersion=(0, 1, 0),
    ShowInput_Enabled=False,
    ShowInput_Path=False,
    SynchronousSolve=True)  # disabled
plot_scatter = Hops(
    XList=jitter.Values,
    YList=jitter_2.Values,
    CacheResultsInMemory=True,
    CacheSolveResults=True,
    RemoteDefinitionLocation="http://127.0.0.1:5000/plot_scatter1",
    RemoteSolveVersion=(0, 1, 0),
    ShowInput_Enabled=False,
    ShowInput_Path=False,
    SynchronousSolve=True)  # disabled
plot_graph = Hops(
    XList=jitter.Values,
    YList=jitter_2.Values,
    CacheResultsInMemory=True,
    CacheSolveResults=True,
    RemoteDefinitionLocation="http://127.0.0.1:5000/plot_graph",
    RemoteSolveVersion=(0, 1, 0),
    ShowInput_Enabled=False,
    ShowInput_Path=False,
    SynchronousSolve=True)  # disabled
plot_bar = Hops(
    XList=jitter.Values,
    YList=jitter_2.Values,
    CacheResultsInMemory=True,
    CacheSolveResults=True,
    RemoteDefinitionLocation="http://127.0.0.1:5000/plot_bar",
    RemoteSolveVersion=(0, 1, 0),
    ShowInput_Enabled=False,
    ShowInput_Path=False,
    SynchronousSolve=True)  # disabled
plot_pie = Hops(
    XList=jitter.Values,
    YList=jitter_2.Values,
    CacheResultsInMemory=True,
    CacheSolveResults=True,
    RemoteDefinitionLocation="http://127.0.0.1:5000/plot_pie",
    RemoteSolveVersion=(0, 1, 0),
    ShowInput_Enabled=False,
    ShowInput_Path=False,
    SynchronousSolve=True)  # disabled
plot_donut = Hops(
    XList=jitter.Values,
    YList=jitter_2.Values,
    CacheResultsInMemory=True,
    CacheSolveResults=True,
    RemoteDefinitionLocation="http://127.0.0.1:5000/plot_donut",
    RemoteSolveVersion=(0, 1, 0),
    ShowInput_Enabled=False,
    ShowInput_Path=False,
    SynchronousSolve=True)  # disabled
panel = Panel(linear_regression)
panel_2 = Panel(plot_graph)
panel_3 = Panel(plot_bar)
panel_4 = Panel(linear_regression_plot)
panel_5 = Panel(plot_scatter)
panel_6 = Panel(plot_pie)
