# Grasshopper definition PFHG_016.gh (Grasshopper 1.0.7)
# plug-ins: Hops

# FLASK | HOPS | PYTHON 3 | GRASSHOPPER
# PFHG_016.gh
# PANDAS
# /panda_series
# /panda_dataframes
number_slider = Slider(7, range=0..10)
series = Series(Start=Slider(10, range=0..10), Step=1, Count=Slider(5, range=0..10))
series_2 = Series(Start=Slider(0, range=0..10), Step=1, Count=Slider(5, range=0..10))
series_3 = Series(Start=number_slider, Step=1, Count=Slider(5, range=0..10))
panel = Panel(series)
panel_2 = Panel(series_2)
panel_3 = Panel(series_3)
panda_series = Hops(
    XList=panel_3,
    CacheResultsInMemory=True,
    CacheSolveResults=True,
    RemoteDefinitionLocation="http://127.0.0.1:5000/panda_series",
    RemoteSolveVersion=(0, 1, 0),
    ShowInput_Enabled=False,
    ShowInput_Path=False,
    SynchronousSolve=True)
panda_dataframe = Hops(
    XList=panel,
    YList=panel_2,
    CacheResultsInMemory=True,
    CacheSolveResults=True,
    RemoteDefinitionLocation="http://127.0.0.1:5000/panda_dataframe",
    RemoteSolveVersion=(0, 1, 0),
    ShowInput_Enabled=False,
    ShowInput_Path=False,
    SynchronousSolve=True)
panel_4 = Panel(panda_series)
panel_5 = Panel(panda_dataframe)
panel_6 = Panel("C:\Users\Sculpture\Desktop\PythonFlaskGrasshopper\compute.rhino3d-master\src\ghhops-server-py\examples\nba.csv")
# PANDAS
# /panda_series_index
number_slider_2 = Slider(0, range=0..10)
file_path = FilePath(panel_6)
series_4 = Series(Start=number_slider_2, Step=1, Count=Slider(20, range=0..20))
panda_dataframe_csv4 = Hops(
    CacheResultsInMemory=True,
    CacheSolveResults=True,
    RemoteDefinitionLocation="http://127.0.0.1:5000/panda_dataframe_csv4",
    RemoteSolveVersion=(0, 1, 0),
    ShowInput_Enabled=False,
    ShowInput_Path=False,
    SynchronousSolve=True)
panel_7 = Panel(series_4)
hops = Hops(
    XList=panel_7,
    CacheResultsInMemory=True,
    CacheSolveResults=True,
    RemoteDefinitionLocation="http://127.0.0.1:5000/panda_series_index",
    RemoteSolveVersion=(0, 1, 0),
    ShowInput_Enabled=False,
    ShowInput_Path=False,
    SynchronousSolve=True)
panel_8 = Panel(panda_dataframe_csv4)
panel_9 = Panel(hops)
