# Grasshopper definition PFHG_018.gh (Grasshopper 1.0.7)
# plug-ins: LunchBox, Hops

# Generating variations on image data:
panel = Panel("Colorblk.jpg")
# Sampling data in different ways:
panel_2 = Panel("Colors.txt")
panel_3 = Panel("C:\Users\Sculpture\Desktop\PythonFlaskGrasshopper\compute.rhino3d-master\src\ghhops-server-py\examples\Colors.txt")

# ----
# FLASK | HOPS | PYTHON 3 | GRASSHOPPER
# PFHG_018.gh
# DATA SCIENCE
# 4 DUMMIES
# working with real data:
# LUNCHBOX PLUG-IN
read_csv = ReadCSV(Delimiter=",")  # -> Headers, Values
create_csv = CreateCSV(Delimiter=",")

file_path = FilePath("Colors.txt")
file_path_2 = FilePath("Colors.txt")
file_path_3 = FilePath(panel)
file_path_4 = FilePath("Colorblk.jpg")
file_path_5 = FilePath("Colors.txt")
file_path_6 = FilePath(panel_2)
file_path_7 = FilePath(panel_3)
file_path_8 = FilePath("Colors.txt")
file_path_9 = FilePath("Colors.txt")
open_txt_int = Hops(
    FilePath=file_path_8,
    Count=Slider(60, range=0..100),
    CacheResultsInMemory=True,
    CacheSolveResults=True,
    RemoteDefinitionLocation="http://127.0.0.1:5000/open_txt_int",
    RemoteSolveVersion=(0, 1, 0),
    ShowInput_Enabled=False,
    ShowInput_Path=False,
    SynchronousSolve=True)
open_txt_stream4 = Hops(
    FilePath=file_path_2,
    CacheResultsInMemory=True,
    CacheSolveResults=True,
    RemoteDefinitionLocation="http://127.0.0.1:5000/open_txt_stream4",
    RemoteSolveVersion=(0, 1, 0),
    ShowInput_Enabled=False,
    ShowInput_Path=False,
    SynchronousSolve=True)
read_file = ReadFile(File=file_path_7, PerLineParse=True)
open_txt = Hops(
    FilePath=file_path_9,
    CacheResultsInMemory=True,
    CacheSolveResults=True,
    RemoteDefinitionLocation="http://127.0.0.1:5000/open_txt",
    RemoteSolveVersion=(0, 1, 0),
    ShowInput_Enabled=False,
    ShowInput_Path=False,
    SynchronousSolve=True)
open_image3 = Hops(
    FilePath=file_path_3,
    CacheResultsInMemory=False,
    CacheSolveResults=False,
    RemoteDefinitionLocation="http://127.0.0.1:5000/open_image3",
    RemoteSolveVersion=(0, 1, 0),
    ShowInput_Enabled=False,
    ShowInput_Path=False,
    SynchronousSolve=True)
open_image5 = Hops(
    FilePath=file_path_4,
    CacheResultsInMemory=True,
    CacheSolveResults=True,
    RemoteDefinitionLocation="http://127.0.0.1:5000/open_image5",
    RemoteSolveVersion=(0, 1, 0),
    ShowInput_Enabled=False,
    ShowInput_Path=False,
    SynchronousSolve=True)  # -> Shape, Size
open_txt_mod = Hops(
    FilePath=file_path_5,
    Mod=Slider(2, range=1..4),
    CacheResultsInMemory=True,
    CacheSolveResults=True,
    RemoteDefinitionLocation="http://127.0.0.1:5000/open_txt_mod",
    RemoteSolveVersion=(0, 1, 0),
    ShowInput_Enabled=False,
    ShowInput_Path=False,
    SynchronousSolve=True)
open_txt_sample5 = Hops(
    FilePath=file_path_6,
    CacheResultsInMemory=True,
    CacheSolveResults=True,
    RemoteDefinitionLocation="http://127.0.0.1:5000/open_txt_sample5",
    RemoteSolveVersion=(0, 1, 0),
    ShowInput_Enabled=False,
    ShowInput_Path=False,
    SynchronousSolve=True)
open_txt_random2 = Hops(
    FilePath=file_path,
    Prob=Slider(0.38, range=0..1),
    CacheResultsInMemory=True,
    CacheSolveResults=True,
    RemoteDefinitionLocation="http://127.0.0.1:5000/open_txt_random2",
    RemoteSolveVersion=(0, 1, 0),
    ShowInput_Enabled=False,
    ShowInput_Path=False,
    SynchronousSolve=True)
panel_4 = Panel(open_txt)
panel_5 = Panel(open_txt_int)
panel_6 = Panel(open_txt_stream4)
panel_7 = Panel(open_txt_random2)
panel_8 = Panel(open_txt_mod)
panel_9 = Panel(open_txt_sample5)
read_csv_2 = ReadCSV(CSVString=read_file, Delimiter=",")  # -> Headers, Values
panel_10 = Panel(open_image5.Shape)
panel_11 = Panel(open_image5.Size)
panel_12 = Panel(read_csv_2.Headers)
panel_13 = Panel(read_csv_2.Values)

file_path_10 = FilePath("Titanic.csv")
read_csv_list2 = Hops(
    FilePath=file_path_10,
    CacheResultsInMemory=True,
    CacheSolveResults=True,
    RemoteDefinitionLocation="http://127.0.0.1:5000/read_csv_list2",
    RemoteSolveVersion=(0, 1, 0),
    ShowInput_Enabled=False,
    ShowInput_Path=False,
    SynchronousSolve=True)
panel_14 = Panel(read_csv_list2)

# ----
# Accessing Data in Structured Flat-File Form:
panel_15 = Panel("Colors.txt")
# Considering using regex to parse the 's
# out fo the strings and the ,s
panel_16 = Panel("Titanic.csv")
file_path_11 = FilePath("Titanic.csv")
file_path_12 = FilePath(panel_15)
file_path_13 = FilePath(panel_16)
read_csv_list4 = Hops(
    FilePath=file_path_11,
    CacheResultsInMemory=True,
    CacheSolveResults=True,
    RemoteDefinitionLocation="http://127.0.0.1:5000/read_csv_list4",
    RemoteSolveVersion=(0, 1, 0),
    ShowInput_Enabled=False,
    ShowInput_Path=False,
    SynchronousSolve=True)
hops = Hops(
    FilePath=file_path_12,
    CacheResultsInMemory=True,
    CacheSolveResults=True,
    RemoteDefinitionLocation="http://127.0.0.1:5000/read_table6",
    RemoteSolveVersion=(0, 1, 0),
    ShowInput_Enabled=False,
    ShowInput_Path=False,
    SynchronousSolve=True)
panel_17 = Panel(read_csv_list4)
panel_18 = Panel(hops)
# Reading Excel and other Microsoft
# Office Files:
panel_19 = Panel("Values.xls")

file_path_14 = FilePath("Values.xls")
# JSON and YAML
read_excel_list = Hops(
    FilePath=file_path_14,
    CacheResultsInMemory=True,
    CacheSolveResults=True,
    RemoteDefinitionLocation="http://127.0.0.1:5000/read_excel_list",
    RemoteSolveVersion=(0, 1, 0),
    ShowInput_Enabled=False,
    ShowInput_Path=False,
    SynchronousSolve=True)
panel_20 = Panel(read_excel_list)

file_path_15 = FilePath(panel_19)
read_excel3 = Hops(
    FilePath=file_path_15,
    CacheResultsInMemory=True,
    CacheSolveResults=True,
    RemoteDefinitionLocation="http://127.0.0.1:5000/read_excel3",
    RemoteSolveVersion=(0, 1, 0),
    ShowInput_Enabled=False,
    ShowInput_Path=False,
    SynchronousSolve=True)
# Sending Data in Unstructured
# File Form:
# Sending Data in Unstructured File Form
# http://scipy-lectures.org/packages/scikit-image/
# from skimage.io import imread
# save for a later date
# 
# Managing Data from Relational Databases:
# 
# SQL
# The Structured Query Language:
# from sqalchemy import create_engine
# engine = create_engine('sqlite:///memory:')
# 
# 
# # read_sql_table(): read a table from a database
# # read_sql_query(): read a query from a database
# # read_sql_frame(): read a query from a database
# # read_sql(): read a query from a database
# # DataFrame.to_sql(): write a DataFrame to a SQL database
# 
# # SQLite
# # MySQL
# # PostgreSQL
# # SQL Server
# # Other relational databases, such as Oracle, Microsoft SQL Server, etc.
# 
# # Interacting with Data from NoSQL Databases
# # Other NoSQL databases, such as MongoDB, CouchDB, Redis, Cassandra, etc.
# 
# #Accessing Data from the Web
# 
# # XML
panel_21 = Panel(read_excel3)
# XML
# need to find way to .values similar
# to .values in csv files
panel_22 = Panel("XMLDataCopy.xml")
file_path_16 = FilePath("XMLDataCopy.xml")
file_path_17 = FilePath(panel_22)
xmldatacopy = Hops(
    FilePath=file_path_17,
    CacheResultsInMemory=True,
    CacheSolveResults=True,
    RemoteDefinitionLocation="http://127.0.0.1:5000/XMLDataCopy",
    RemoteSolveVersion=(0, 1, 0),
    ShowInput_Enabled=False,
    ShowInput_Path=False,
    SynchronousSolve=True)
xmldatacopy5 = Hops(
    FilePath=file_path_16,
    CacheResultsInMemory=True,
    CacheSolveResults=True,
    RemoteDefinitionLocation="http://127.0.0.1:5000/XMLDataCopy5",
    RemoteSolveVersion=(0, 1, 0),
    ShowInput_Enabled=False,
    ShowInput_Path=False,
    SynchronousSolve=True)
# Conditioning Your Data:
# 
# Validating Your Data:
panel_23 = Panel(xmldatacopy)
panel_24 = Panel(xmldatacopy5)
