# Grasshopper definition PythonServer_001.gh (Grasshopper 1.0.7)
# plug-ins: Hops

# McNeel, Compute | AECtech 2021 NYC
# Setting up a Python Server
# https://www.youtube.com/watch?v=v_Y2-5VpCSQ
# 1:46:00 minute make
# 
# preresquisites:
# Visual Studio Code
# CPython 3.10 or higher
# CMake 3.22 or higher
# https://www.kitware.com/cmake-3-22-0-available-for-download/
# 
# 
# Flask (optional middle ware)
# 
# 
# Close repo at:
# https://github.com/mcneel/compute.rhino3d
# 
# pip install ghhops_server flask
# 
# Got to Visual Studio Code
# open  folder, src, ghhops-server.py, examples
# This starts server
# check out @hops definitions:
# 
# @hops.component(
#     "/pointat",
#     name="PointAt",
#     nickname="PtAt",
#     description="Get point along curve",
#     icon="pointat.png",
#     inputs=[
#         hs.HopsCurve("Curve", "C", "Curve to evaluate"),
#         hs.HopsNumber("t", "t", "Parameter on Curve to evaluate")
#     ],
#     outputs=[hs.HopsPoint("P", "P", "Point on curve at t")]
# )
# def pointat(curve: rhino3dm.Curve, t=0.0):
#     return curve.PointAt(t)
# 
# Now you can use all the  Python 3.0 Libraries
# NumPy
# Pandas
# DataFrames
# etc...
# 
# Visual Studio Code
# Terminal
# IP address
# over to grasshopper and hops component
# use the
# /pointat locator
# WOW!!!
number_slider = Slider(0.64, range=0..2)
curve = Curve(<curve referenced from the Rhino model>)
curve_2 = Curve(<curve referenced from the Rhino model>)
hops = Hops(
    Curve=reparameterize(curve),
    T=number_slider,
    CacheResultsInMemory=True,
    CacheSolveResults=True,
    RemoteDefinitionLocation="http://127.0.0.1:5000/pointat",
    RemoteSolveVersion=(0, 1, 0),
    ShowInput_Enabled=False,
    ShowInput_Path=False,
    SynchronousSolve=True)
hops_2 = Hops(
    Curve=curve_2,
    T=Slider(0.64, range=0..2),
    CacheResultsInMemory=True,
    CacheSolveResults=True,
    RemoteDefinitionLocation="http://127.0.0.1:5000/pointat",
    RemoteSolveVersion=(0, 1, 0),
    ShowInput_Enabled=False,
    ShowInput_Path=False,
    SynchronousSolve=True)
